# Grasshopper definition Githopper.gh (Grasshopper 1.0.6)

# ---- group: Committing / Commit Changes/ Commit
python = GhPythonScript()  # -> report, help; inputs files: list, commit: Boolean
# ---------- python: Python ----------
"""Commits the changes to the selected files
    Inputs:
        files: List of the selected files
        message: commit message
        commit: Triggers the git command (Button)
    Output:
        report: Output of the git operation
        help: Helpful tips about the git oporation"""

__author__ = "Amir Hossein Oliaee"
__version__ = "2019.06.24"

from subprocess import check_output
import subprocess
import os
import scriptcontext as rsc

def executor(cmd):
    """
    This function executes the given command in the form of a list
    * It returns the output of the cmd prompt as a raw string
    """
    
    try:
        out_put = check_output(["cmd", "/C"] + cmd, creationflags=0x08000000)
    except subprocess.CalledProcessError as cpe_error:
        out_put = cpe_error.output
    out_put = str(out_put, "utf-8")
    
    return out_put

def commiter(msg="No comment", f=[]):
    """
    This function saves the selected portion of the gh file from clipboard
    and commits it with the given massage
    * files: a list of file names that will be committed
    * if files contains "-A" then all files will be committed 
    """
    
    commit_msg = "" 
    
    for i in f:
        try:
            executor(["git", "add", str(i)])
        except:
            commit_msg += "Could not add" + str(i) + "to the repository\n"
    
    commit_msg += executor(["git", "commit" , "-m", msg])
    
    return commit_msg


# CWD area ---------------------------------------------------------------------

try:
    rsc.sticky["git_path"]
    os.chdir(rsc.sticky["git_path"])
except:
    pass

# Command execution area + help ------------------------------------------------

help = "Press the commit button to commit the changes (to the selected files)\n"

if message == None or message.startswith("Double click"):
    message = "Commit message not specified"
    help += "\n* Are you sure you don't want to leave a message ?!\n"

if len(files) == 0 or files == None:
    files = ["-A"]
    help += "\n* All files will be committed"

r = None
if commit == True:
    r = commiter(message,files)

# Sticky area ------------------------------------------------------------------

try:
    rsc.sticky["Githopper_14"]
except:
    rsc.sticky["Githopper_14"] = None

# Report area ------------------------------------------------------------------

if rsc.sticky["Githopper_14"] == None:
    rsc.sticky["Githopper_14"] = r
    report = r
else:
    report = rsc.sticky["Githopper_14"]
    rsc.sticky["Githopper_14"] = None
# ---------- end python ----------

# ---- group: Committing / Reset to Last Commit / Undo
python_2 = GhPythonScript()  # -> report, help; inputs reset: Boolean
# ---------- python_2: Python ----------
"""Resets the files to the last commit state
    Inputs:
        reset: Triggers the git command (Button)
    Output:
        report: Output of the git operation
        help: Helpful tips about the git oporation"""

__author__ = "Amir Hossein Oliaee"
__version__ = "2019.06.24"

from subprocess import check_output, Popen
import subprocess
import os
import scriptcontext as rsc

def executor(cmd):
    """
    This function executes the given command in the form of a list
    * It returns the output of the cmd prompt as a raw string
    """
    
    try:
        Popen(["cmd", "/C"] + cmd, creationflags=0x08000000)
    except:
        pass


# CWD area ---------------------------------------------------------------------

try:
    rsc.sticky["git_path"]
    os.chdir(rsc.sticky["git_path"])
except:
    pass

# Command execution area -------------------------------------------------------

r = None
if reset == True:
    executor(["git", "reset", "--hard"])
    r = "The repository has been reset to the last commit"

# Help production area ---------------------------------------------------------

help = "Press the reset button to reset the project to the state of the last commit"

# Sticky area ------------------------------------------------------------------

try:
    rsc.sticky["Githopper_17"]
except:
    rsc.sticky["Githopper_17"] = None

# Report area ------------------------------------------------------------------

if rsc.sticky["Githopper_17"] == None:
    rsc.sticky["Githopper_17"] = r
    report = r
else:
    report = rsc.sticky["Githopper_17"]
    rsc.sticky["Githopper_17"] = None
# ---------- end python_2 ----------

# ---- group: Begining
panel = Panel("https://github.com/oliaee/git-hopper.git")
panel_2 = Panel("https://github.com/oliaee/git-hopper.git")
panel_3 = Panel("C:\Users\Oliaee\Documents\Git\git-hopper")
panel_4 = Panel("C:\Users\Oliaee\Desktop\New folder_33")
panel_5 = Panel("oliaee")
panel_6 = Panel("oliaee_a@yahoo.com")
toggle = BooleanToggle(False)

# ---- group: Merging / Merge Branch / Merge
python_3 = GhPythonScript()  # -> help; inputs favor_this_side: Boolean, manual_resolve: Boolean, merge: Boolean
# ---------- python_3: Python ----------
"""Merges the selected branch into the current one
    Inputs:
        branch: The selected branch to merge into the current one
        favor_this_side: Determines whether to resolve conflicts by favoring this side of the merge (Toggle)
        manual_resolve: Determines whether to leave conflict solving to the user (Toggle)
        merge: Triggers the git command (Button)
    Output:
        help: Output of the git operation / Helpful tips"""

__author__ = "Amir Hossein Oliaee"
__version__ = "2019.06.24"

from subprocess import check_output
import subprocess
import os
import scriptcontext as rsc

def executor(cmd):
    """
    This function executes the given command in the form of a list
    * It returns the output of the cmd prompt as a raw string
    """
    
    try:
        out_put = check_output(["cmd", "/C"] + cmd, creationflags=0x08000000)
    except subprocess.CalledProcessError as cpe_error:
        out_put = cpe_error.output
    out_put = str(out_put, "utf-8")
    
    return out_put


# CWD area ---------------------------------------------------------------------

try:
    rsc.sticky["git_path"]
    os.chdir(rsc.sticky["git_path"])
except:
    pass


if branch:
    help = "Press the merge button to merge the selected branch into the courent branch\n"
else:
    help = ("Please enter a branch and press the merge button to merge the "
              "selected branch into the courent branch\n")

if not manual_resolve:
    help += "\n* Merge conflicts will be resolved automatically\n"
    if favor_this_side:
        conf_manager = "--strategy-option=ours"
        help += ("\n* In the case of a conflict it will be resolved"
                   " by favoring this side of the conflict")
    else:
        conf_manager = "--strategy-option=theirs"
        help += ("\n* In the case of a conflict it will be resolved"
                   " by favoring the other side of the conflict")
else:
    conf_manager = "manual"
    help += ("\n* Conflicting files will be altered\n"
              "\n* You have to manualy edit the files and resolve the conflicts"
              "\n\n* After manualy resolving the conflict make sure to use "
              "the \"Conflict Manager\" component to either resolve the merge "
              "conflict or abort the oporation")

if merge and branch:
    if conf_manager != "manual":
        executor(["git", "merge", "--no-ff", conf_manager, branch])
    else:
        executor(["git", "merge", "--no-ff", branch])
# ---------- end python_3 ----------

# ---- group: Utility / Conflict Manager / Conflict
python_4 = GhPythonScript()  # -> report, help; inputs resolve: Boolean, abort: Boolean
# ---------- python_4: Python ----------
"""Finishes the conflict resolve operation
    Inputs:
        resolve: Ends the merge operation (Button)
        abort: Aborts the merge operation (Button)
    Output:
        report: Output of the git operation
        help: Helpful tips about the git oporation"""

__author__ = "Amir Hossein Oliaee"
__version__ = "2019.06.24"

from subprocess import check_output
import subprocess
import os
import scriptcontext as rsc

def executor(cmd):
    """
    This function executes the given command in the form of a list
    * It returns the output of the cmd prompt as a raw string
    """
    
    try:
        out_put = check_output(["cmd", "/C"] + cmd, creationflags=0x08000000)
    except subprocess.CalledProcessError as cpe_error:
        out_put = cpe_error.output
    out_put = str(out_put, "utf-8")
    
    return out_put

def finish_merge(abort):
    """
    Finishes the merge process by continuing or aborting the oporation
    """

    if abort:
        try:
            fm_msg = executor(["git","merge","--abort"])
        except subprocess.CalledProcessError as cpe_error:
            fm_msg = cpe_error.output
            fm_msg = str(fm_msg, "utf-8")
    else:
        try:
            fm_msg = executor(["git","merge","--continue"])
        except subprocess.CalledProcessError as cpe_error:
            fm_msg = cpe_error.output
            fm_msg = str(fm_msg, "utf-8")
    
    return fm_msg


# CWD area ---------------------------------------------------------------------

try:
    rsc.sticky["git_path"]
    os.chdir(rsc.sticky["git_path"])
except:
    pass

# Command execution area -------------------------------------------------------

r = None
if resolve != abort:
    if resolve:
        r = finish_merge(False)
        if r != "" : r += "\n"
        r += "* Resolved conflicts will be implimented (check repository status for more info)"
    
    if abort:
        r = finish_merge(True)
        if r != "" : r += "\n"
        r = "The merge oporation will be aborted and file changes will be cancelled"


# Help production area ---------------------------------------------------------

help = "Press the abort or resolve button to finish resolving the merge conflict\n"

if resolve == True and abort == True:
    help += "\n* You can not resolve and abort the oporation at the sae time !"

# Sticky area ------------------------------------------------------------------

try:
    rsc.sticky["Githopper_24"]
except:
    rsc.sticky["Githopper_24"] = None

# Report area ------------------------------------------------------------------

if rsc.sticky["Githopper_24"] == None:
    rsc.sticky["Githopper_24"] = r
    report = r
else:
    report = rsc.sticky["Githopper_24"]
    rsc.sticky["Githopper_24"] = None
# ---------- end python_4 ----------

# ---- group: Merging / Push to Repository / Push
python_5 = GhPythonScript()  # -> help; inputs push: Boolean
# ---------- python_5: Python ----------
"""Pushes the local repository changes to the remote repository
    Inputs:
        branch: Name of the branch to be pushed
        repository: URL Address of the remote repository
        push: Triggers the git command (Button)
    Output:
        help: Output of the git operation / Helpful tips"""

__author__ = "Amir Hossein Oliaee"
__version__ = "2019.06.24"

from subprocess import check_output, Popen
import subprocess
import os
import scriptcontext as rsc

def executor(cmd):
    """
    This function executes the given command in the form of a list
    * It returns the output of the cmd prompt as a raw string
    """
    
    try:
        Popen(["cmd", "/C"] + cmd)
    except:
        pass

def pusher(options):
    """
    pushes repository to server
    """
    
    executor(["git", "push"] + options)


# CWD area ---------------------------------------------------------------------

try:
    rsc.sticky["git_path"]
    os.chdir(rsc.sticky["git_path"])
except:
    pass

# Command execution area -------------------------------------------------------

push_options = []

if branch == None or branch == "": push_options.append("--all")

if repository == None or repository == "":
    push_options.append("origin")
else:
    push_options.append(repository)

if branch != None: push_options.append(branch)

if push:
    pusher(push_options)

# Help production area ---------------------------------------------------------

if branch and repository:
    help = "Press the push button to push the selected branch to the selected remote repository\n"
elif branch:
    help = "Press the push button to push all branches to the selected remote repository\n"
else:
    help = "Press the push button to push all branches to the remote repository\n"
# ---------- end python_5 ----------

# ---- group: Committing / Modify Last Commit / Modify
python_6 = GhPythonScript()  # -> report, help; inputs files: list, modify: Boolean
# ---------- python_6: Python ----------
"""Modifies the last commit
    Inputs:
        files: List of the selected files
        message: The new message to replace the last commit's message
        modify: Triggers the git command (Button)
    Output:
        report: Output of the git operation
        help: Helpful tips about the git oporation"""

__author__ = "Amir Hossein Oliaee"
__version__ = "2019.06.24"

from subprocess import check_output
import subprocess
import os
import scriptcontext as rsc

def executor(cmd):
    """
    This function executes the given command in the form of a list
    * It returns the output of the cmd prompt as a raw string
    """
    
    try:
        out_put = check_output(["cmd", "/C"] + cmd, creationflags=0x08000000)
    except subprocess.CalledProcessError as cpe_error:
        out_put = cpe_error.output
    out_put = str(out_put, "utf-8")
    
    return out_put

def amender(msg, f=[]):
    """
    This function saves the selected portion of the gh file from clipboard
    and commits it with the given massage
    * files: a list of file names that will be committed
    * if files contains "-A" then all files will be committed 
    """
    
    commit_msg = "" 
    
    for i in f:
        try:
            executor(["git", "add", str(i)])
        except:
            commit_msg += "Could not add" + str(i) + "to the repository\n"
    
    if msg == None or msg == "":
        commit_msg += executor(["git", "commit", "--amend", "--no-edit"])
    else:
        commit_msg += executor(["git", "commit", "--amend", "-m", msg])
    
    return commit_msg

# CWD area ---------------------------------------------------------------------

try:
    rsc.sticky["git_path"]
    os.chdir(rsc.sticky["git_path"])
except:
    pass

# Command execution area -------------------------------------------------------

r = None
if modify == True:
    r = amender(message, files)


# Help production area ---------------------------------------------------------

help = "Press the modify button to modify the last commit\n"
if message == None: help += "\n* You can change the last commit's message by entering a message"

# Sticky area ------------------------------------------------------------------

try:
    rsc.sticky["Githopper_15"]
except:
    rsc.sticky["Githopper_15"] = None

# Report area ------------------------------------------------------------------

if rsc.sticky["Githopper_15"] == None:
    rsc.sticky["Githopper_15"] = r
    report = r
else:
    report = rsc.sticky["Githopper_15"]
    rsc.sticky["Githopper_15"] = None
# ---------- end python_6 ----------

# ---- group: Commit List / Commits
python_7 = GhPythonScript()  # -> commits; inputs check: Boolean
# ---------- python_7: Python ----------
"""Lists all the commits in the local git repository
    Inputs:
        check: Refreshes the List (Button)
    Output:
        commits: List of all the commits in the git repository"""

__author__ = "Amir Hossein Oliaee"
__version__ = "2019.06.24"

from subprocess import check_output
import subprocess
import os
import scriptcontext as rsc

def executor(cmd):
    """
    This function executes the given command in the form of a list
    * It returns the output of the cmd prompt as a raw string
    """
    
    try:
        out_put = check_output(["cmd", "/C"] + cmd, creationflags=0x08000000)
    except subprocess.CalledProcessError as cpe_error:
        out_put = cpe_error.output
    out_put = str(out_put, "utf-8")
    
    return out_put

def log():
    """
    This function provides a log of commits
    """

    log_msg = executor(["git", "log", "--oneline"])

    return log_msg


# CWD area ---------------------------------------------------------------------

try:
    rsc.sticky["git_path"]
    os.chdir(rsc.sticky["git_path"])
except:
    pass


commits = log()
# ---------- end python_7 ----------

# ---- group: Committing / Hard Reset / Reset
python_8 = GhPythonScript()  # -> help; inputs reset: Boolean
# ---------- python_8: Python ----------
"""Resets the repository to the selected commit (deletes the commits after that)
    Inputs:
        commit: The selected commit to reset to
        reset: Triggers the git command (Button)
    Output:
        help: Helpful tips about the git oporation"""

__author__ = "Amir Hossein Oliaee"
__version__ = "2019.06.24"

from subprocess import check_output, Popen
import subprocess
import os
import scriptcontext as rsc

def executor(cmd):
    """
    This function executes the given command in the form of a list
    * It returns the output of the cmd prompt as a raw string
    """
    
    try:
        Popen(["cmd", "/C"] + cmd, creationflags=0x08000000)
    except:
        pass

# CWD area ---------------------------------------------------------------------

try:
    rsc.sticky["git_path"]
    os.chdir(rsc.sticky["git_path"])
except:
    pass

# Command execution area -------------------------------------------------------

if reset and commit:
    executor(["git", "reset", "--hard",  commit])

# Help production area ---------------------------------------------------------

help = ("Press the reset button to reset the project to the last commit state"
          "\n\n* Warning: this component is dangerous --> All the changes after "
          "selected commit will be erased !!!")

if not commit: help += "\n\n* Please first enter the selected commit"
# ---------- end python_8 ----------

# ---- group: Branching / Branch List / Branches
python_9 = GhPythonScript()  # -> branches; inputs check: Boolean
# ---------- python_9: Python ----------
"""Lists all the branches in the local git repository
    Inputs:
        check: Refreshes the List (Button)
    Output:
        branches: List of all the branches in the git repository"""

__author__ = "Amir Hossein Oliaee"
__version__ = "2019.06.24"

from subprocess import check_output
import subprocess
import os
import scriptcontext as rsc

def executor(cmd):
    """
    This function executes the given command in the form of a list
    * It returns the output of the cmd prompt as a raw string
    """
    
    try:
        out_put = check_output(["cmd", "/C"] + cmd, creationflags=0x08000000)
    except subprocess.CalledProcessError as cpe_error:
        out_put = cpe_error.output
    out_put = str(out_put, "utf-8")
    
    return out_put

def branch_list():
    """
    Returns a list of existing branches
    """
    
    branch_list_msg = executor(["git", "branch"])
    
    return branch_list_msg


# CWD area ---------------------------------------------------------------------

try:
    rsc.sticky["git_path"]
    os.chdir(rsc.sticky["git_path"])
except:
    pass


branches = branch_list()
# ---------- end python_9 ----------

# ----
panel_7 = Panel("""<?xml version="1.0" encoding="utf-8" standalone="yes"?>
<Archive name="Root">
  <!--Grasshopper archive-->
  <!--Grasshopper and GH_IO.dll are copyrighted by Robert McNeel & Associates-->
  <!--Archive generated by GH_IO.dll file utility library {0.2.0002}-->
  <items count="1">
    <item name="ArchiveVersion" type_name="gh_version" type_code="80">
      <Major>0</Major>
      <Minor>2</Minor>
      <Revision>2</Revision>
    </item>
  </items>
  <chunks count="1">
    <chunk name="Clipboard">
      <items count="1">
        <item name="plugin_version" type_name="gh_version" type_code="80">
          <Major>1</Major>
          <Minor>0</Minor>
          <Revision>6</Revision>
        </item>
      </items>
      <chunks count="5">
        <chunk name="DocumentHeader">
          <items count="5">
            <item name="DocumentID" type_name="gh_guid" type_code="9">b9371dd2-4a8a-4543-86e8-ebefad801606</item>
            <item name="Preview" type_name="gh_string" type_code="10">Shaded</item>
            <item name="PreviewMeshType" type_name="gh_int32" type_code="3">1</item>
            <item name="PreviewNormal" type_name="gh_drawing_color" type_code="36">
              <ARGB>100;150;0;0</ARGB>
            </item>
            <item name="PreviewSelected" type_name="gh_drawing_color" type_code="36">
              <ARGB>100;0;150;0</ARGB>
            </item>
          </items>
        </chunk>
        <chunk name="DefinitionProperties">
          <items count="3">
            <item name="Date" type_name="gh_date" type_code="8">636919005663969618</item>
            <item name="Description" type_name="gh_string" type_code="10"></item>
            <item name="Name" type_name="gh_string" type_code="10"></item>
          </items>
          <chunks count="3">
            <chunk name="Revisions">
              <items count="1">
                <item name="RevisionCount" type_name="gh_int32" type_code="3">0</item>
              </items>
            </chunk>
            <chunk name="Projection">
              <items count="2">
                <item name="Target" type_name="gh_drawing_point" type_code="30">
                  <X>-460</X>
                  <Y>292</Y>
                </item>
                <item name="Zoom" type_name="gh_single" type_code="5">1.4770478</item>
              </items>
            </chunk>
            <chunk name="Views">
              <items count="1">
                <item name="ViewCount" type_name="gh_int32" type_code="3">0</item>
              </items>
            </chunk>
          </chunks>
        </chunk>
        <chunk name="RcpLayout">
          <items count="1">
            <item name="GroupCount" type_name="gh_int32" type_code="3">0</item>
          </items>
        </chunk>
        <chunk name="GHALibraries">
          <items count="1">
            <item name="Count" type_name="gh_int32" type_code="3">0</item>
          </items>
        </chunk>
        <chunk name="DefinitionObjects">
          <items count="1">
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""")  # disabled

# ---- group: Branching / Create Branch / Branch +
python_10 = GhPythonScript()  # -> report, help; inputs create: Boolean
# ---------- python_10: Python ----------
"""Initializes the git repository (git init equivalent)
    Inputs:
        name: The name of the created branch
        create: Triggers the git command (Button)
    Output:
        report: Output of the git operation
        help: Helpful tips about the git oporation"""

__author__ = "Amir Hossein Oliaee"
__version__ = "2019.06.24"

from subprocess import check_output
import subprocess
import os
import scriptcontext as rsc

def executor(cmd):
    """
    This function executes the given command in the form of a list
    * It returns the output of the cmd prompt as a raw string
    """
    
    try:
        out_put = check_output(["cmd", "/C"] + cmd, creationflags=0x08000000)
    except subprocess.CalledProcessError as cpe_error:
        out_put = cpe_error.output
    out_put = str(out_put, "utf-8")
    
    return out_put

def create_branch(name):
    """
    creates a branch with the given name
    """
    
    cb_msg = executor(["git", "branch", name])
    
    return name


# CWD area ---------------------------------------------------------------------

try:
    rsc.sticky["git_path"]
    os.chdir(rsc.sticky["git_path"])
except:
    pass

# Command execution area -------------------------------------------------------

r = None
if create == True and name != None and not(name.count(" ") or name.count("\n")):
    r = create_branch(name) + " created"

# Help production area ---------------------------------------------------------

help = "Press the create button to create the new branch\n"
if not name: help +="\n* You need to enter a branch name first\n"
try:
    if name.count(" ") or name.count("\n"): help +="\n* Branch name can't conntain spaces or new lines\n"
except:
    pass

# Sticky area ------------------------------------------------------------------

try:
    rsc.sticky["Githopper_9"]
except:
    rsc.sticky["Githopper_9"] = None

# Report area ------------------------------------------------------------------

if rsc.sticky["Githopper_9"] == None:
    rsc.sticky["Githopper_9"] = r
    report = r
else:
    report = rsc.sticky["Githopper_9"]
    rsc.sticky["Githopper_9"] = None
# ---------- end python_10 ----------

# ---- group: Branching / Switch Branch
python_11 = GhPythonScript()  # -> report, help; inputs switch: Boolean
# ---------- python_11: Python ----------
"""Switches to the selected branch
    Inputs:
        branch: The name of the branch to switch to
        switch: Triggers the git command (Button)
    Output:
        report: Output of the git operation
        help: Helpful tips about the git oporation"""

__author__ = "Amir Hossein Oliaee"
__version__ = "2019.06.24"

from subprocess import check_output
import subprocess
import os
import scriptcontext as rsc

def executor(cmd):
    """
    This function executes the given command in the form of a list
    * It returns the output of the cmd prompt as a raw string
    """
    
    try:
        out_put = "You have successfully switched branch\n\n"
        out_put += check_output(["cmd", "/C"] + cmd, creationflags=0x08000000)
    except subprocess.CalledProcessError as cpe_error:
        out_put = "You have not switched branch\n"
        out_put += cpe_error.output
    out_put = str(out_put, "utf-8")
    
    return out_put

def change_branch(branch_name):
    """
    switches to the selected branch
    """
    
    cb_msg = executor(["git", "checkout", branch_name])
    
    return cb_msg


# CWD area ---------------------------------------------------------------------

try:
    rsc.sticky["git_path"]
    os.chdir(rsc.sticky["git_path"])
except:
    pass

# Help production area ---------------------------------------------------------

help = "Press the switch button to switch to the selected branch\n"
if not branch: help +="\n* You need to enter a branch name first\n"
help += "\n* You can use the 'select Branch' component to choose a branch\n"

# Command execution area -------------------------------------------------------

r = None
if switch and branch:
    r = change_branch(branch)

# Sticky area ------------------------------------------------------------------

try:
    rsc.sticky["Githopper_11"]
except:
    rsc.sticky["Githopper_11"] = None

# Report area ------------------------------------------------------------------

if rsc.sticky["Githopper_11"] == None:
    rsc.sticky["Githopper_11"] = r
    report = r
else:
    report = rsc.sticky["Githopper_11"]
    rsc.sticky["Githopper_11"] = None
# ---------- end python_11 ----------

# ---- group: Status / Check Status / Status
python_12 = GhPythonScript()  # -> status; inputs check: Boolean
# ---------- python_12: Python ----------
"""Provides a status report of the local git repository
    Inputs:
        check: Refreshes the status (Button)
    Output:
        status: Status report of the local git repository"""

__author__ = "Amir Hossein Oliaee"
__version__ = "2019.06.24"

from subprocess import check_output
import subprocess
import os
import scriptcontext as rsc

def executor(cmd):
    """
    This function executes the given command in the form of a list
    * It returns the output of the cmd prompt as a raw string
    """
    
    try:
        out_put = check_output(["cmd", "/C"] + cmd, creationflags=0x08000000)
    except subprocess.CalledProcessError as cpe_error:
        out_put = cpe_error.output
    out_put = str(out_put, "utf-8")
    
    return out_put

def stat():
    """
    reports the status of the local repository
    """
    
    status_msg = executor(["git", "status"])
    
    return status_msg


# CWD area ---------------------------------------------------------------------

try:
    rsc.sticky["git_path"]
    os.chdir(rsc.sticky["git_path"])
except:
    pass


status = stat()
# ---------- end python_12 ----------

# ---- group: Status / Branch Graph / Graph
python_13 = GhPythonScript()  # -> graph
# ---------- python_13: Python ----------
"""Provides a text graph of commits including branches and merges
    Inputs:
        check: Refreshes the graph (Button)
    Output:
        graph: Text graph of commits"""

__author__ = "Amir Hossein Oliaee"
__version__ = "2019.06.24"

from subprocess import check_output
import subprocess
import os
import scriptcontext as rsc

def executor(cmd):
    """
    This function executes the given command in the form of a list
    * It returns the output of the cmd prompt as a raw string
    """
    
    try:
        out_put = check_output(["cmd", "/C"] + cmd, creationflags=0x08000000)
    except subprocess.CalledProcessError as cpe_error:
        out_put = cpe_error.output
    out_put = str(out_put, "utf-8")
    
    return out_put

def graph():

    """
    This function provides an ANSI text graph of the local repository
    """

    graph_msg = executor(["git", "log", "--graph", "--oneline", "--decorate", "--all"])

    return graph_msg


# CWD area ---------------------------------------------------------------------

try:
    rsc.sticky["git_path"]
    os.chdir(rsc.sticky["git_path"])
except:
    pass


graph = graph()
# ---------- end python_13 ----------

# ---- group: Begining / Git Path / Path
python_14 = GhPythonScript(path=panel_3, set=Button())  # -> report, help; inputs create_path: Boolean, set: Boolean
# ---------- python_14: Python ----------
"""Changes the git working directory from the current location
    Inputs:
        path: The working directory path to be used by git
        create_path: Determines whether the given path will be created (Toggle)
        set: Triggers the git command (Button)
    Output:
        report: Output of the git operation
        help: Helpful tips about the git oporation"""

__author__ = "Amir Hossein Oliaee"
__version__ = "2019.06.24"

import os
import scriptcontext as rsc

if set and path:
    if (not os.path.exists(path)) and create_path:
        os.mkdir(path)
    os.chdir(path)
    rsc.sticky["git_path"] = os.getcwd()

help = "Press the set button To set the git path\n"
if not path: help+= "\n * You need to first enter a path\n"
if not create_path : help += "\n* If the path doeasn't exist, you can use the create_path option"


report = "The current working directory is:\n" + str(os.getcwd())
# ---------- end python_14 ----------

# ---- group: Begining / Create Git Repository / Create Git
python_15 = GhPythonScript(user_name=panel_5, user_email=panel_6, initialize=Button())  # -> report, help; inputs initialize: Boolean
# ---------- python_15: Python ----------
"""Initializes the git repository (git init equivalent)
    Inputs:
        user_name: The username used to sign git commits by Githopper
        user_email: The email used to sign git commits by Githopper
        initialize: Triggers the git command (Button)
    Output:
        report: Output of the git operation
        help: Helpful tips about the git oporation"""

__author__ = "Amir Hossein Oliaee"
__version__ = "2019.06.24"

from subprocess import check_output, Popen
import subprocess
import os
import scriptcontext as rsc

def executor(cmd):
    """
    This function executes the given command in the form of a list
    """
    
    try:
        out_put = Popen(["cmd", "/C"] + cmd)
    except:
        pass

def executor_alt(cmd):
    """
    This function executes the given command in the form of a list
    * It returns the output of the cmd prompt as a raw string
    """
    
    try:
        out_put = check_output(["cmd", "/C"] + cmd, creationflags=0x08000000)
    except subprocess.CalledProcessError as cpe_error:
        out_put = cpe_error.output
    out_put = str(out_put, "utf-8")
    
    return out_put

def init(user_name, user_email):
    
    if user_name:
        executor_alt(["git", "config", "--global", "user.name", user_name])
    if user_email:
        executor_alt(["git", "config", "--global", "user.email", user_email])
    
    cwd = os.getcwd().split("\\")
    if cwd.pop() != "System":
        executor(["git", "init"])
    else:
        return ("Error: The repository could not be created\n"
                "\n* Please use the \"Git Path\" component to specify the path "
                "for your local git repository")
        
    if os.path.exists(".git"):
        init_msg = "The git repository initialized successfully"
    else:
        return ("Error: The repository could not be created\n"
            "\n* Please make sure you have done the following:\n"
            "1 - Install the Git software from www.git-scm.com\n"
            "2 - Set Rhino to Run as Administrator if you are using the C drive")
    
    return init_msg


# CWD area ---------------------------------------------------------------------

try:
    rsc.sticky["git_path"]
    os.chdir(rsc.sticky["git_path"])
except:
    pass

# Command execution area -------------------------------------------------------

r = None
if initialize:
    r = init(user_name, user_email)

# Help production area ---------------------------------------------------------

help = "Press the initialize button to create the new repository\n"
if not user_name: help +="\n* You need to enter a user_name first\n"
if not user_email: help += "\n* You need to enter a user_email first\n"

# Sticky area ------------------------------------------------------------------

try:
    rsc.sticky["Githopper_2"]
except:
    rsc.sticky["Githopper_2"] = None

# Report area ------------------------------------------------------------------

if rsc.sticky["Githopper_2"] == None:
    rsc.sticky["Githopper_2"] = r
    report = r
else:
    report = rsc.sticky["Githopper_2"]
    rsc.sticky["Githopper_2"] = None
# ---------- end python_15 ----------

# ---- group: Begining / Clone Repository / Clone
python_16 = GhPythonScript(URL=panel, location=panel_4, user_name="oliaee", user_email="oliaee_a@yahoo.com", clone=Button())  # -> help
# ---------- python_16: Python ----------
"""Clones a remote git repository (makes a local copy)
    Inputs:
        URL: Address of the remote git repository (GitHub link)
        location: Location that is used to store the cloned git repository
        user_name: The username used to sign git commits by Githopper
        user_email: The email used to sign git commits by Githopper
        clone: Triggers the git command (Button)
    Output:
        help: Helpful tips about the git oporation"""

__author__ = "Amir Hossein Oliaee"
__version__ = "2019.06.24"

from subprocess import check_output, Popen
import subprocess
import os
import scriptcontext as rsc

def executor(cmd):
    """
    This function executes the given command in the form of a list
    """
    
    try:
        Popen(["cmd", "/C"] + cmd)
    except:
        pass

def executor_alt(cmd):
    """
    This function executes the given command in the form of a list
    * It returns the output of the cmd prompt as a raw string
    """
    
    try:
        out_put = check_output(["cmd", "/C"] + cmd, creationflags=0x08000000)
    except subprocess.CalledProcessError as cpe_error:
        out_put = cpe_error.output
    out_put = str(out_put, "utf-8")
    
    return out_put

def clone_repository(repository_address, user_name, user_email):
    """
    Clones the remote repository from it's address
    """
    
    a = executor_alt(["git", "config", "--global", "user.name"])
    b = executor_alt(["git", "config", "--global", "user.email"])
    
    if user_name and user_email:
        creds = ["git", "config", "--global","user.name", user_name]
        creds += ["&", "git", "config", "--global", "user.email", user_email]
        executor_alt(creds)
    
    if a and b:
        executor(["git", "clone", str(repository_address)])


# CWD area ---------------------------------------------------------------------

try:
    rsc.sticky["git_path"]
    os.chdir(rsc.sticky["git_path"])
except:
    pass

# Command execution area -------------------------------------------------------

if clone and URL and location:
    if not os.path.exists(location): os.mkdir(location)
    real_location = os.getcwd()
    os.chdir(location)
    clone_repository(URL, user_name, user_email)
    os.chdir(real_location)

# Help production area ---------------------------------------------------------

help = "Press the clone button to clone the remote repository\n"

if not URL:
    help += ("\n* Please enter the git url."
              "\n  For example:"
              "\n  https://github.com/account/Project\n")

if not location:
    help += ("\n* Please enter the location."
              "\n  For example:"
              "\n  C:\\Projects\n")

if not (executor_alt(["git", "config", "--global", "user.name"]) and executor_alt(["git", "config", "--global", "user.email"])):
    help += ("\n* You must enter a user_name and user_email for the first time")
# ---------- end python_16 ----------

# ---- group: Begining / Set Remote Address / Remote
python_17 = GhPythonScript(URL=panel_2, replace=toggle)  # -> report, help; inputs replace: Boolean, set: Boolean
# ---------- python_17: Python ----------
"""Sets/Changes the address of remote repository for git
    Inputs:
        URL: Address of the remote git repository (GitHub link)
        replace: Determines whether an existing remote address could be replaced
        set: Triggers the git command (Button)
    Output:
        report: Output of the git operation
        help: Helpful tips about the git oporation"""

__author__ = "Amir Hossein Oliaee"
__version__ = "2019.06.24"

from subprocess import check_output
import subprocess
import os
import scriptcontext as rsc

def executor(cmd):
    """
    This function executes the given command in the form of a list
    * It returns the output of the cmd prompt as a raw string
    """
    
    try:
        out_put = check_output(["cmd", "/C"] + cmd, creationflags=0x08000000)
    except subprocess.CalledProcessError as cpe_error:
        out_put = cpe_error.output
    out_put = str(out_put, "utf-8")
    
    return out_put

def change_origin(url, r=False):
    co_msg = executor(["git", "remote", "add", "origin", url])
    
    if r : co_msg = executor(["git", "remote", "set-url", "origin", url])
    
    return co_msg


# CWD area ---------------------------------------------------------------------

try:
    rsc.sticky["git_path"]
    os.chdir(rsc.sticky["git_path"])
except:
    pass

# Command execution area -------------------------------------------------------

r = None
if str(URL).endswith(".git") and str(URL).startswith("https:") and set:
    change_origin(URL, replace)
    r = "The remote address is as follows:\n" + executor(["git", "remote", "-v"])

# Help production area ---------------------------------------------------------

help = "Press the set button to set the remote repository address\n"

if not URL:
    help += ("\n* Please enter the git url."
              "\n  For example:"
              "\n  https://github.com/account/Project\n")

if not replace:
    help += "\n* If you want to allow git to overwrite old remote addresses, set replace toggle to True\n"
else:
    help += "\n* The old remote addresses will be overwriten\n"

# Sticky area ------------------------------------------------------------------

try:
    rsc.sticky["Githopper_4"]
except:
    rsc.sticky["Githopper_4"] = None

# Report area ------------------------------------------------------------------

if rsc.sticky["Githopper_4"] == None:
    rsc.sticky["Githopper_4"] = r
    report = r
else:
    report = rsc.sticky["Githopper_4"]
    rsc.sticky["Githopper_4"] = None
# ---------- end python_17 ----------

# ----
toggle_2 = BooleanToggle(False)  # disabled
toggle_3 = BooleanToggle(False)  # disabled

# ---- group: Merging / Pull from Repository / Pull
python_18 = GhPythonScript()  # -> help; inputs favor_this_side: Boolean, manual_resolve: Boolean, pull: Boolean
# ---------- python_18: Python ----------
"""Pulls the remote repository changes to the local repository
    Inputs:
        branch: Name of the branch to be pulled
        favor_this_side: Determines whether to resolve conflicts by favoring this side of the pull (Toggle)
        manual_resolve: Determines whether to leave conflict solving to the user (Toggle)
        pull: Triggers the git command (Button)
    Output:
        help: Output of the git operation / Helpful tips"""

__author__ = "Amir Hossein Oliaee"
__version__ = "2019.06.24"

from subprocess import check_output, Popen
import subprocess
import os
import scriptcontext as rsc

def executor(cmd):
    """
    This function executes the given command in the form of a list
    * It returns the output of the cmd prompt as a raw string
    """
    
    try:
        Popen(["cmd", "/C"] + cmd)
    except:
        pass

def puller(options):
    """
    pushes repository to server
    """
    
    executor(["git", "pull"] + options)


# CWD area ---------------------------------------------------------------------

try:
    rsc.sticky["git_path"]
    os.chdir(rsc.sticky["git_path"])
except:
    pass

# Command execution area & help ------------------------------------------------

if not manual_resolve:
    help = "Merge conflicts will be resolved automatically\n"
    if favor_this_side:
        conf_manager = "--strategy-option=ours"
        help += ("\n* In the case of a conflict it will be resolved"
                   " by favoring this side of the conflict")
    else:
        conf_manager = "--strategy-option=theirs"
        help += ("\n* In the case of a conflict it will be resolved"
                   " by favoring the other side of the conflict")
else:
    conf_manager = "manual"
    help = ("Conflicting files will be altered\n"
              "\n* You have to manualy edit the files and resolve the conflicts"
              "\n\n* After manualy resolving the conflict make sure to use "
              "\"Finish Conflict\" component to either resolve the merge conflict"
              " or abort the oporation")

pull_options = []

if branch == None or branch == "": pull_options.append("--all")

if conf_manager != "manual":
    pull_options.append(conf_manager)

if branch != None: pull_options.append(branch)

if pull:
    puller(pull_options)
# ---------- end python_18 ----------

# ---- group: Committing / Select File
python_19 = GhPythonScript()  # -> files, directory; inputs indexes: list, select_all: Boolean
# ---------- python_19: Python ----------
"""Selects files in the working directory
    Inputs:
        indexes: Indexs of the selected files inside the directory (int list)
        select_all: Determines whether all files should be selected (Toggle)
    Output:
        files: Selected files
        directory: List of all the files inside the current directory"""

__author__ = "Amir Hossein Oliaee"
__version__ = "2019.06.24"

from os import listdir, getcwd
from os.path import isfile, join
import scriptcontext as rsc


# CWD area ---------------------------------------------------------------------

try:
    rsc.sticky["git_path"]
    os.chdir(rsc.sticky["git_path"])
except:
    pass

# Command execution area -------------------------------------------------------

mypath = getcwd()
f_list = listdir(mypath)

try:
    f_list.remove(".git")
except:
    pass

if len(indexes) == 1:
    indexes = indexes[0].split("\n")
    indexes = [i.strip("\r") for i in indexes]

temp_list = []
for i in indexes:
    try:
        temp_list.append(int(i))
    except:
        pass
indexes = temp_list

files = []
directory = []

for f in range(len(f_list)):
    if isfile(join(mypath, f_list[f])):
        if f in indexes:
            files.append(f_list[f])
            directory.append ("> " + str(f_list[f]))
        else:
            directory.append ("  " + str(f_list[f]))
    else:
        if f in indexes:
            files.append(f_list[f])
            directory.append ("> " + str(f_list[f]) + " (dir)")
        else:
            directory.append ("  " + str(f_list[f]) + " (dir)")

if select_all:
    files = ["-A"]
    directory = ["> " + str(f) for f in f_list]
# ---------- end python_19 ----------

# ---- group: Utility / Execute Git Command / Execute
python_20 = GhPythonScript()  # -> help; inputs execute: Boolean
# ---------- python_20: Python ----------
"""Executes the given custom git command
    Inputs:
        command: The custom git command to run
        execute: Triggers the git command (Button)
    Output:
        help: Output of the git operation / Helpful tips"""

__author__ = "Amir Hossein Oliaee"
__version__ = "2019.06.24"

from subprocess import check_output, Popen
import subprocess
import os
import scriptcontext as rsc

def executor(cmd):
    """
    This function executes the given command in the form of a list
    * It returns the output of the cmd prompt as a raw string
    """
    
    try:
        Popen(["cmd", "/K"] + cmd)
    except:
        pass

def parser(cmd):
    def index_finder(text,char):
        out_put = []
        b = 0
        
        for i in range(50):
            try:
                b = text.index(char, b+1)
                out_put.append(b)
            except:
                break
        
        return out_put
    
    a = sorted(index_finder(cmd, "'") + index_finder(cmd, "\""))
    slices = [cmd[a[i]+1:a[i+1]] for i in range(0,len(a),2)]
    for i in slices: cmd = cmd.replace(i, "<>")
    cmd = cmd.split(" ")
    
    out_put = []
    for i in cmd:
        if  "<>" in i:
            out_put.append(slices.pop(0))
        else:
            out_put.append(i)
    
    return out_put


# CWD area ---------------------------------------------------------------------

try:
    rsc.sticky["git_path"]
    os.chdir(rsc.sticky["git_path"])
except:
    pass

# Command execution area & help ------------------------------------------------

try:
    command_lst = command.split(" ")
    
    if command_lst[0] == "git" and execute:
        executor(parser(command))
    elif command_lst[0] != "git":
        help = "Invalid command (Please only use git commands)"
    else:
        help = ("Press execute button to run the command"
                  "\n\n* make sure to put file names in quotation or double quotation"
                  "\nExample:\ngit checkout HEAD~1 'some file.txt'")

except:
    help = "You haven't entered a git command"
# ---------- end python_20 ----------

# ---- group: Committing / Select Commit
python_21 = GhPythonScript()  # -> commit, commits; inputs index: Int32
# ---------- python_21: Python ----------
"""Selects a git commit
    Inputs:
        index: index of the selected commit inside the commits list (int)
    Output:
        commit: The selected commit
        commits: List of all commits inside the local git repository"""

__author__ = "Amir Hossein Oliaee"
__version__ = "2019.06.24"

from subprocess import check_output
import subprocess
import os
import scriptcontext as rsc

def executor(cmd):
    """
    This function executes the given command in the form of a list
    * It returns the output of the cmd prompt as a raw string
    """
    
    try:
        out_put = check_output(["cmd", "/C"] + cmd, creationflags=0x08000000)
    except subprocess.CalledProcessError as cpe_error:
        out_put = cpe_error.output
    out_put = str(out_put, "utf-8")
    
    return out_put

def log():
    """
    This function provides a log of commits
    """

    log_msg = executor(["git", "log", "--oneline"])

    return log_msg


# CWD area ---------------------------------------------------------------------

try:
    rsc.sticky["git_path"]
    os.chdir(rsc.sticky["git_path"])
except:
    pass


try:
    commits = log()
    
    if not len(commits):
        commits = "nothing has been commited yet"
    
    raw = commits.strip("\n")
    raw = raw.split("\n")
    
    commits = []
    for i in range(len(raw)):
        raw[i] = raw[i].split(" ")
        if i == index:
            commits.append("> " + " ".join(raw[i][1:]))
            commit = raw[i][0]
        else:
            commits.append("  " + " ".join(raw[i][1:]))
except:
    commit = "No commit has been selected"
# ---------- end python_21 ----------

# ---- group: Merging / Force Push / Force
python_22 = GhPythonScript()  # -> help; inputs force: Boolean
# ---------- python_22: Python ----------
"""Forcefully Pushes the local repository changes to the remote repository
    Inputs:
        branch: Name of the branch to be pushed
        repository: URL Address of the remote repository
        force: Triggers the git command (Button)
    Output:
        help: Output of the git operation / Helpful tips"""

__author__ = "Amir Hossein Oliaee"
__version__ = "2019.06.24"

from subprocess import check_output, Popen
import subprocess
import os
import scriptcontext as rsc

def executor(cmd):
    """
    This function executes the given command in the form of a list
    * It returns the output of the cmd prompt as a raw string
    """
    
    try:
        Popen(["cmd", "/C"] + cmd)
    except:
        pass

def pusher(options):
    """
    pushes repository to server
    """
    
    executor(["git", "push"] + options)


# CWD area ---------------------------------------------------------------------

try:
    rsc.sticky["git_path"]
    os.chdir(rsc.sticky["git_path"])
except:
    pass

# Command execution area -------------------------------------------------------

push_options = ["--force"]

if branch == None: push_options.append("--all")

if repository == None:
    push_options.append("origin")
else:
    push_options.append(repository)

if branch != None: push_options.append(branch)

if force:
    pusher(push_options)

# Help production area ---------------------------------------------------------

help = ("Press the force_push button to replace the remote repository with "
          "your local git repository"
          "\n\n* Warning: this component is dangerous --> It will completely "
          "wipe out the git history of your remote repository !!!"
          "\n\n* This component will not effect your local repository")
# ---------- end python_22 ----------

# ---- group: Branching / Select Branch
python_23 = GhPythonScript()  # -> branch, branches; inputs index: Int32
# ---------- python_23: Python ----------
"""Selects the a git branch
    Inputs:
        index: index of the selected branch inside the branches list (int)
    Output:
        branch: The selected branch
        branches: List of all branches inside the local git repository"""

__author__ = "Amir Hossein Oliaee"
__version__ = "2019.06.24"

from subprocess import check_output
import subprocess
import os
import scriptcontext as rsc

def executor(cmd):
    """
    This function executes the given command in the form of a list
    * It returns the output of the cmd prompt as a raw string
    """
    
    try:
        out_put = check_output(["cmd", "/C"] + cmd, creationflags=0x08000000)
    except subprocess.CalledProcessError as cpe_error:
        out_put = cpe_error.output
    out_put = str(out_put, "utf-8")
    
    return out_put


def branch_list():
    """
    Returns a list of existing branches
    """
    
    branch_list_msg = executor(["git", "branch"])
    
    return branch_list_msg


# CWD area ---------------------------------------------------------------------

try:
    rsc.sticky["git_path"]
    os.chdir(rsc.sticky["git_path"])
except:
    pass

# Command execution area -------------------------------------------------------

branches = branch_list()

raw = branches.strip("\n")
raw = raw.split("\n")
branch = None
branches = []
for i in range(len(raw)):
    raw[i] = raw[i].strip("*")
    raw[i] = raw[i].strip(" ")

    if i == index:
        branches.append( "> " + raw[i])
        branch = raw[i]
    else:
        branches.append( "  " + raw[i])
# ---------- end python_23 ----------

# ---- group: Committing / Revert File / Revert
python_24 = GhPythonScript()  # -> report, help; inputs files: list, revert: Boolean
# ---------- python_24: Python ----------
"""Reverts the selected files to the selected commit's state
    Inputs:
        commit: Selected commit to revert the files state to
        files: Selected files to revert
        revert: Triggers the git command (Button)
    Output:
        report: Output of the git operation
        help: Helpful tips about the git oporation"""

__author__ = "Amir Hossein Oliaee"
__version__ = "2019.06.24"

from subprocess import check_output
import subprocess
import os
import scriptcontext as rsc

def executor(cmd):
    """
    This function executes the given command in the form of a list
    * It returns the output of the cmd prompt as a raw string
    """
    
    try:
        out_put = check_output(["cmd", "/C"] + cmd, creationflags=0x08000000)
    except subprocess.CalledProcessError as cpe_error:
        out_put = cpe_error.output
    out_put = str(out_put, "utf-8")
    
    return out_put


# CWD area ---------------------------------------------------------------------

try:
    rsc.sticky["git_path"]
    os.chdir(rsc.sticky["git_path"])
except:
    pass

# Command execution area -------------------------------------------------------

r = None
if revert and commit and files:
    if files[0] == "-A":
        r = "You can not revert all files (you can use \"hard reset\" component for that)"
    else:
        r = ""
        for i in files:
            try:
                temp = executor(["git", "checkout", commit, str(i)]) + "\n"
                if temp != None or temp != "":
                    r += temp
            except:
                r += "Could not revert " + str(i) + "\n"
        if r == None or r == "":
            r = "revert oporation finished"

# Help production area ---------------------------------------------------------

help = "Press the revert button to revert the selected files to the selected commit state"
if not commit: help += "\n\n* Please first enter the commit"
if not files: help += "\n\n* Please remember to add the file names"

# Sticky area ------------------------------------------------------------------

try:
    rsc.sticky["Githopper_19"]
except:
    rsc.sticky["Githopper_19"] = None

# Report area ------------------------------------------------------------------

if rsc.sticky["Githopper_19"] == None:
    rsc.sticky["Githopper_19"] = r
    report = r
else:
    report = rsc.sticky["Githopper_19"]
    rsc.sticky["Githopper_19"] = None
# ---------- end python_24 ----------

# ---- group: Branching / Delete Branch / Branch -
python_25 = GhPythonScript()  # -> report, help; inputs delete: Boolean
# ---------- python_25: Python ----------
"""Deletes the selected branch
    Inputs:
        branch: The name of the branch to be deleted
        force: Determines whether the delete operation should be forced (Toggle)
        delete: Triggers the git command (Button)
    Output:
        report: Output of the git operation
        help: Helpful tips about the git oporation"""

__author__ = "Amir Hossein Oliaee"
__version__ = "2019.06.24"


from subprocess import check_output
import subprocess
import os
import scriptcontext as rsc

def executor(cmd):
    """
    This function executes the given command in the form of a list
    * It returns the output of the cmd prompt as a raw string
    """
    
    try:
        out_put = check_output(["cmd", "/C"] + cmd, creationflags=0x08000000)
    except subprocess.CalledProcessError as cpe_error:
        out_put = cpe_error.output
    out_put = str(out_put, "utf-8")
    
    return out_put

def delete_branch(branch_name):
    """
    deletes the selected branch
    """
    
    db_msg = executor(["git", "branch", "-D", str(branch_name)])
    
    return db_msg


# CWD area ---------------------------------------------------------------------

try:
    rsc.sticky["git_path"]
    os.chdir(rsc.sticky["git_path"])
except:
    pass

# Command execution area -------------------------------------------------------

r = None
if branch != "master":
    if delete and branch != None:
        r = delete_branch(branch)
else:
    r = "master branch can't be deleted"

# Help production area ---------------------------------------------------------

help = "Press the delete button to delete the selected branch\n"
if not branch: help +="\n* You need to enter a branch name first\n"
help += "\n* You can use the 'select Branch' component to choose a branch\n"

# Sticky area ------------------------------------------------------------------

try:
    rsc.sticky["Githopper_10"]
except:
    rsc.sticky["Githopper_10"] = None

# Report area ------------------------------------------------------------------

if rsc.sticky["Githopper_10"] == None:
    rsc.sticky["Githopper_10"] = r
    report = r
else:
    report = rsc.sticky["Githopper_10"]
    rsc.sticky["Githopper_10"] = None
# ---------- end python_25 ----------

# ---- group: get clipboard content
c_script = CSharpScript(triger=toggle_2)  # -> out, A; inputs triger: Boolean; disabled
# ---------- c_script: C# usings ----------
using System.Windows.Forms;
# ---------- c_script: C# ----------
    if (triger == true)
    {
      A = Clipboard.GetText();
    }
# ---------- end c_script ----------

# ---- group: set clipboard content
c_script_2 = CSharpScript(txt=panel_7, triger=toggle_3)  # -> out; inputs txt: String, triger: Boolean; disabled
# ---------- c_script_2: C# ----------
    if (triger == true)
    {
      Clipboard.SetText(txt);
    }
# ---------- end c_script_2 ----------

# ----
_20 = GhPythonScript()  # -> help; inputs favor_this_side: Boolean, manual_resolve: Boolean, merge: Boolean
# ---------- _20: Python ----------
"""Merges the selected branch into the current one
    Inputs:
        branch: The selected branch to merge into the current one
        favor_this_side: Determines whether to resolve conflicts by favoring this side of the merge (Toggle)
        manual_resolve: Determines whether to leave conflict solving to the user (Toggle)
        merge: Triggers the git command (Button)
    Output:
        help: Output of the git operation / Helpful tips"""

__author__ = "Amir Hossein Oliaee"
__version__ = "2019.06.24"

from ghpythonlib.componentbase import executingcomponent as component
import Grasshopper, GhPython
import System
import Rhino
import rhinoscriptsyntax as rs
from subprocess import check_output
import subprocess
import os
import scriptcontext as rsc

class MyComponent(component):
    
    def RunScript(self, branch, favor_this_side, manual_resolve, merge):
        
        help = None
        
        def executor(cmd):
            """
            This function executes the given command in the form of a list
            * It returns the output of the cmd prompt as a raw string
            """
            
            try:
                out_put = check_output(["cmd", "/C"] + cmd, creationflags=0x08000000)
            except subprocess.CalledProcessError as cpe_error:
                out_put = cpe_error.output
            out_put = str(out_put, "utf-8")
            
            return out_put
        
        
        # CWD area ---------------------------------------------------------------------
        
        try:
            rsc.sticky["git_path"]
            os.chdir(rsc.sticky["git_path"])
        except:
            pass
        
        
        if branch:
            help = "Press the merge button to merge the selected branch into the courent branch\n"
        else:
            help = ("Please enter a branch and press the merge button to merge the "
                      "selected branch into the courent branch\n")
        
        if not manual_resolve:
            help += "\n* Merge conflicts will be resolved automatically\n"
            if favor_this_side:
                conf_manager = "--strategy-option=ours"
                help += ("\n* In the case of a conflict it will be resolved"
                           " by favoring this side of the conflict")
            else:
                conf_manager = "--strategy-option=theirs"
                help += ("\n* In the case of a conflict it will be resolved"
                           " by favoring the other side of the conflict")
        else:
            conf_manager = "manual"
            help += ("\n* Conflicting files will be altered\n"
                      "\n* You have to manualy edit the files and resolve the conflicts"
                      "\n\n* After manualy resolving the conflict make sure to use "
                      "the \"Conflict Manager\" component to either resolve the merge "
                      "conflict or abort the oporation")
        
        if merge and branch:
            if conf_manager != "manual":
                executor(["git", "merge", "--no-ff", conf_manager, branch])
            else:
                executor(["git", "merge", "--no-ff", branch])
        
        return help
# ---------- end _20 ----------
_1 = GhPythonScript()  # -> report, help; inputs create_path: Boolean, set: Boolean
# ---------- _1: Python ----------
"""Changes the git working directory from the current location
    Inputs:
        path: The working directory path to be used by git
        create_path: Determines whether the given path will be created (Toggle)
        set: Triggers the git command (Button)
    Output:
        report: Output of the git operation
        help: Helpful tips about the git oporation"""

__author__ = "Amir Hossein Oliaee"
__version__ = "2019.06.24"

import os
import scriptcontext as rsc
from ghpythonlib.componentbase import executingcomponent as component
import Grasshopper, GhPython
import System
import Rhino
import rhinoscriptsyntax as rs

class MyComponent(component):
    
    def RunScript(self, path, create_path, set):
        
        report = None
        help = None
        
        if set and path:
            if (not os.path.exists(path)) and create_path:
                os.mkdir(path)
            os.chdir(path)
            rsc.sticky["git_path"] = os.getcwd()
        
        help = "Press the set button To set the git path\n"
        if not path: help+= "\n * You need to first enter a path\n"
        if not create_path : help += "\n* If the path doeasn't exist, you can use the create_path option"
        
        
        report = "The current working directory is:\n" + str(os.getcwd())
        
        return (report, help)
# ---------- end _1 ----------
_2 = GhPythonScript()  # -> report, help; inputs initialize: Boolean
# ---------- _2: Python ----------
"""Initializes the git repository (git init equivalent)
    Inputs:
        user_name: The username used to sign git commits by Githopper
        user_email: The email used to sign git commits by Githopper
        initialize: Triggers the git command (Button)
    Output:
        report: Output of the git operation
        help: Helpful tips about the git oporation"""

__author__ = "Amir Hossein Oliaee"
__version__ = "2019.06.24"

from ghpythonlib.componentbase import executingcomponent as component
import Grasshopper, GhPython
import System
import Rhino
import rhinoscriptsyntax as rs
from subprocess import check_output, Popen
import subprocess
import os
import scriptcontext as rsc

class MyComponent(component):
    
    def RunScript(self, user_name, user_email, initialize):
        
        report = None
        help = None
        
        def executor(cmd):
            """
            This function executes the given command in the form of a list
            """
            
            try:
                out_put = Popen(["cmd", "/C"] + cmd)
            except:
                pass
        
        def executor_alt(cmd):
            """
            This function executes the given command in the form of a list
            * It returns the output of the cmd prompt as a raw string
            """
            
            try:
                out_put = check_output(["cmd", "/C"] + cmd, creationflags=0x08000000)
            except subprocess.CalledProcessError as cpe_error:
                out_put = cpe_error.output
            out_put = str(out_put, "utf-8")
            
            return out_put
        
        def init(user_name, user_email):
            
            if user_name:
                executor_alt(["git", "config", "--global", "user.name", user_name])
            if user_email:
                executor_alt(["git", "config", "--global", "user.email", user_email])
            
            cwd = os.getcwd().split("\\")
            if cwd.pop() != "System":
                executor(["git", "init"])
            else:
                return ("Error: The repository could not be created\n"
                        "\n* Please use the \"Git Path\" component to specify the path "
                        "for your local git repository")
                
            if os.path.exists(".git"):
                init_msg = "The git repository initialized successfully"
            else:
                return ("Error: The repository could not be created\n"
                    "\n* Please make sure you have done the following:\n"
                    "1 - Install the Git software from www.git-scm.com\n"
                    "2 - Set Rhino to Run as Administrator if you are using the C drive")
            
            return init_msg
        
        # CWD area ---------------------------------------------------------------------
        
        try:
            rsc.sticky["git_path"]
            os.chdir(rsc.sticky["git_path"])
        except:
            pass
        
        # Command execution area -------------------------------------------------------
        
        r = None
        if initialize:
            r = init(user_name, user_email)
        
        # Help production area ---------------------------------------------------------
        
        help = "Press the initialize button to create the new repository\n"
        if not user_name: help +="\n* You need to enter a user_name first\n"
        if not user_email: help += "\n* You need to enter a user_email first\n"
        
        # Sticky area ------------------------------------------------------------------
        
        try:
            rsc.sticky["Githopper_2"]
        except:
            rsc.sticky["Githopper_2"] = None
        
        # Report area ------------------------------------------------------------------
        
        if rsc.sticky["Githopper_2"] == None:
            rsc.sticky["Githopper_2"] = r
            report = r
        else:
            report = rsc.sticky["Githopper_2"]
            rsc.sticky["Githopper_2"] = None
        
        return (report, help)
# ---------- end _2 ----------
_3 = GhPythonScript()  # -> help
# ---------- _3: Python ----------
"""Clones a remote git repository (makes a local copy)
    Inputs:
        URL: Address of the remote git repository (GitHub link)
        location: Location that is used to store the cloned git repository
        user_name: The username used to sign git commits by Githopper
        user_email: The email used to sign git commits by Githopper
        clone: Triggers the git command (Button)
    Output:
        help: Helpful tips about the git oporation"""

__author__ = "Amir Hossein Oliaee"
__version__ = "2019.06.24"

from ghpythonlib.componentbase import executingcomponent as component
import Grasshopper, GhPython
import System
import Rhino
import rhinoscriptsyntax as rs
from subprocess import check_output, Popen
import subprocess
import os
import scriptcontext as rsc

class MyComponent(component):
    
    def RunScript(self, URL, location, user_name, user_email, clone):
        
        def executor(cmd):
            """
            This function executes the given command in the form of a list
            """
            
            try:
                Popen(["cmd", "/C"] + cmd)
            except:
                pass
        
        def executor_alt(cmd):
            """
            This function executes the given command in the form of a list
            * It returns the output of the cmd prompt as a raw string
            """
            
            try:
                out_put = check_output(["cmd", "/C"] + cmd, creationflags=0x08000000)
            except subprocess.CalledProcessError as cpe_error:
                out_put = cpe_error.output
            out_put = str(out_put, "utf-8")
            
            return out_put
        
        def clone_repository(repository_address, user_name, user_email):
            """
            Clones the remote repository from it's address
            """
            
            a = executor_alt(["git", "config", "--global", "user.name"])
            b = executor_alt(["git", "config", "--global", "user.email"])
            
            if user_name and user_email:
                creds = ["git", "config", "--global","user.name", user_name]
                creds += ["&", "git", "config", "--global", "user.email", user_email]
                executor_alt(creds)
            
            if a and b:
                executor(["git", "clone", str(repository_address)])
        
        # CWD area ---------------------------------------------------------------------
        
        try:
            rsc.sticky["git_path"]
            os.chdir(rsc.sticky["git_path"])
        except:
            pass
        
        # Command execution area -------------------------------------------------------
        
        if clone and URL and location:
            if not os.path.exists(location): os.mkdir(location)
            real_location = os.getcwd()
            os.chdir(location)
            clone_repository(URL, user_name, user_email)
            os.chdir(real_location)
        
        # Help production area ---------------------------------------------------------
        
        help = "Press the clone button to clone the remote repository\n"
        
        if not URL:
            help += ("\n* Please enter the git url."
                      "\n  For example:"
                      "\n  https://github.com/account/Project\n")
        
        if not location:
            help += ("\n* Please enter the location."
                      "\n  For example:"
                      "\n  C:\\Projects\n")
        
        if not (executor_alt(["git", "config", "--global", "user.name"]) and executor_alt(["git", "config", "--global", "user.email"])):
            help += ("\n* You must enter a user_name and user_email for the first time")
        
        return help
# ---------- end _3 ----------
_7 = GhPythonScript()  # -> branches; inputs check: Boolean
# ---------- _7: Python ----------
"""Lists all the branches in the local git repository
    Inputs:
        check: Refreshes the List (Button)
    Output:
        branches: List of all the branches in the git repository"""

__author__ = "Amir Hossein Oliaee"
__version__ = "2019.06.24"

from subprocess import check_output
import subprocess
import os
import scriptcontext as rsc
from ghpythonlib.componentbase import executingcomponent as component
import Grasshopper, GhPython
import System
import Rhino
import rhinoscriptsyntax as rs

class MyComponent(component):
    
    def RunScript(self, check):
        
        branches = None
        
        def executor(cmd):
            """
            This function executes the given command in the form of a list
            * It returns the output of the cmd prompt as a raw string
            """
            
            try:
                out_put = check_output(["cmd", "/C"] + cmd, creationflags=0x08000000)
            except subprocess.CalledProcessError as cpe_error:
                out_put = cpe_error.output
            out_put = str(out_put, "utf-8")
            
            return out_put
        
        def branch_list():
            """
            Returns a list of existing branches
            """
            
            branch_list_msg = executor(["git", "branch"])
            
            return branch_list_msg
        
        
        # CWD area ---------------------------------------------------------------------
        
        try:
            rsc.sticky["git_path"]
            os.chdir(rsc.sticky["git_path"])
        except:
            pass
        
        
        branches = branch_list()
        
        return branches
# ---------- end _7 ----------
_14 = GhPythonScript()  # -> report, help; inputs files: list, commit: Boolean
# ---------- _14: Python ----------
"""Commits the changes to the selected files
    Inputs:
        files: List of the selected files
        message: commit message
        commit: Triggers the git command (Button)
    Output:
        report: Output of the git operation
        help: Helpful tips about the git oporation"""

__author__ = "Amir Hossein Oliaee"
__version__ = "2019.06.24"

from subprocess import check_output
import subprocess
import os
import scriptcontext as rsc
from ghpythonlib.componentbase import executingcomponent as component
import Grasshopper, GhPython
import System
import Rhino
import rhinoscriptsyntax as rs

class MyComponent(component):
    
    def RunScript(self, files, message, commit):
        
        report = None
        help = None
        
        def executor(cmd):
            """
            This function executes the given command in the form of a list
            * It returns the output of the cmd prompt as a raw string
            """
            
            try:
                out_put = check_output(["cmd", "/C"] + cmd, creationflags=0x08000000)
            except subprocess.CalledProcessError as cpe_error:
                out_put = cpe_error.output
            out_put = str(out_put, "utf-8")
            
            return out_put
        
        def commiter(msg="No comment", f=[]):
            """
            This function saves the selected portion of the gh file from clipboard
            and commits it with the given massage
            * files: a list of file names that will be committed
            * if files contains "-A" then all files will be committed 
            """
            
            commit_msg = "" 
            
            for i in f:
                try:
                    executor(["git", "add", str(i)])
                except:
                    commit_msg += "Could not add" + str(i) + "to the repository\n"
            
            commit_msg += executor(["git", "commit" , "-m", msg])
            
            return commit_msg
        
        
        # CWD area ---------------------------------------------------------------------
        
        try:
            rsc.sticky["git_path"]
            os.chdir(rsc.sticky["git_path"])
        except:
            pass
        
        # Command execution area + help ------------------------------------------------
        
        help = "Press the commit button to commit the changes (to the selected files)\n"
        
        r = None
        if message == None or message.startswith("Double click"):
            message = "Commit message not specified"
            help += "\n* Are you sure you don't want to leave a message ?!\n"
        
        if len(files) == 0 or files == None:
            files = ["-A"]
            help += "\n* All files will be committed"
        
        r= None
        if commit == True:
            r = commiter(message,files)
        
        # Sticky area ------------------------------------------------------------------
        
        try:
            rsc.sticky["Githopper_14"]
        except:
            rsc.sticky["Githopper_14"] = None
        
        # Report area ------------------------------------------------------------------
        
        if rsc.sticky["Githopper_14"] == None:
            rsc.sticky["Githopper_14"] = r
            report = r
        else:
            report = rsc.sticky["Githopper_14"]
            rsc.sticky["Githopper_14"] = None
        
        return (report, help)
# ---------- end _14 ----------
_4 = GhPythonScript()  # -> report, help; inputs replace: Boolean, set: Boolean
# ---------- _4: Python ----------
"""Sets/Changes the address of remote repository for git
    Inputs:
        URL: Address of the remote git repository (GitHub link)
        replace: Determines whether an existing remote address could be replaced
        set: Triggers the git command (Button)
    Output:
        report: Output of the git operation
        help: Helpful tips about the git oporation"""

__author__ = "Amir Hossein Oliaee"
__version__ = "2019.06.24"

from ghpythonlib.componentbase import executingcomponent as component
import Grasshopper, GhPython
import System
import Rhino
import rhinoscriptsyntax as rs
from subprocess import check_output
import subprocess
import os
import scriptcontext as rsc

class MyComponent(component):
    
    def RunScript(self, URL, replace, set):
        
        report = None
        help = None
        
        def executor(cmd):
            """
            This function executes the given command in the form of a list
            * It returns the output of the cmd prompt as a raw string
            """
            
            try:
                out_put = check_output(["cmd", "/C"] + cmd, creationflags=0x08000000)
            except subprocess.CalledProcessError as cpe_error:
                out_put = cpe_error.output
            out_put = str(out_put, "utf-8")
            
            return out_put
        
        def change_origin(url, r=False):
            co_msg = executor(["git", "remote", "add", "origin", url])
            
            if r : co_msg = executor(["git", "remote", "set-url", "origin", url])
            
            return co_msg
        
        
        # CWD area ---------------------------------------------------------------------
        
        try:
            rsc.sticky["git_path"]
            os.chdir(rsc.sticky["git_path"])
        except:
            pass
        
        # Command execution area -------------------------------------------------------
        
        r = None
        if str(URL).endswith(".git") and str(URL).startswith("https:") and set:
            change_origin(URL, replace)
            r = "The remote address is as follows:\n" + executor(["git", "remote", "-v"])
        
        # Help production area ---------------------------------------------------------
        
        help = "Press the set button to set the remote repository address\n"
        
        if not URL:
            help += ("\n* Please enter the git url."
                      "\n  For example:"
                      "\n  https://github.com/account/Project\n")
        
        if not replace:
            help += "\n* If you want to allow git to overwrite old remote addresses, set replace toggle to True\n"
        else:
            help += "\n* The old remote addresses will be overwriten\n"
        
        # Sticky area ------------------------------------------------------------------
        
        try:
            rsc.sticky["Githopper_4"]
        except:
            rsc.sticky["Githopper_4"] = None
        
        # Report area ------------------------------------------------------------------
        
        if rsc.sticky["Githopper_4"] == None:
            rsc.sticky["Githopper_4"] = r
            report = r
        else:
            report = rsc.sticky["Githopper_4"]
            rsc.sticky["Githopper_4"] = None
        
        return (report, help)
# ---------- end _4 ----------
_22 = GhPythonScript()  # -> help; inputs push: Boolean
# ---------- _22: Python ----------
"""Pushes the local repository changes to the remote repository
    Inputs:
        branch: Name of the branch to be pushed
        repository: URL Address of the remote repository
        push: Triggers the git command (Button)
    Output:
        help: Output of the git operation / Helpful tips"""

__author__ = "Amir Hossein Oliaee"
__version__ = "2019.06.24"

from ghpythonlib.componentbase import executingcomponent as component
import Grasshopper, GhPython
import System
import Rhino
import rhinoscriptsyntax as rs
from subprocess import check_output, Popen
import subprocess
import os
import scriptcontext as rsc

class MyComponent(component):
    
    def RunScript(self, branch, repository, push):
        
        help =None
        
        def executor(cmd):
            """
            This function executes the given command in the form of a list
            * It returns the output of the cmd prompt as a raw string
            """
            
            try:
                Popen(["cmd", "/C"] + cmd)
            except:
                pass
        
        def pusher(options):
            """
            pushes repository to server
            """
            
            executor(["git", "push"] + options)
        
        
        # CWD area ---------------------------------------------------------------------
        
        try:
            rsc.sticky["git_path"]
            os.chdir(rsc.sticky["git_path"])
        except:
            pass
        
        # Command execution area -------------------------------------------------------
        
        push_options = []
        
        if branch == None or branch == "": push_options.append("--all")
        
        if repository == None or repository == "":
            push_options.append("origin")
        else:
            push_options.append(repository)
        
        if branch != None: push_options.append(branch)
        
        if push:
            pusher(push_options)
        
        # Help production area ---------------------------------------------------------
        
        if branch and repository:
            help = "Press the push button to push the selected branch to the selected remote repository\n"
        elif branch:
            help = "Press the push button to push all branches to the selected remote repository\n"
        else:
            help = "Press the push button to push all branches to the remote repository\n"
        
        return help
# ---------- end _22 ----------
_11 = GhPythonScript()  # -> report, help; inputs switch: Boolean
# ---------- _11: Python ----------
"""Switches to the selected branch
    Inputs:
        branch: The name of the branch to switch to
        switch: Triggers the git command (Button)
    Output:
        report: Output of the git operation
        help: Helpful tips about the git oporation"""

__author__ = "Amir Hossein Oliaee"
__version__ = "2019.06.24"

from subprocess import check_output
import subprocess
import os
import scriptcontext as rsc
from ghpythonlib.componentbase import executingcomponent as component
import Grasshopper, GhPython
import System
import Rhino
import rhinoscriptsyntax as rs

class MyComponent(component):
    
    def RunScript(self, branch, switch):
        
        report = None
        help = None
        
        def executor(cmd):
            """
            This function executes the given command in the form of a list
            * It returns the output of the cmd prompt as a raw string
            """
            
            try:
                out_put = "You have successfully switched branch\n\n"
                out_put += check_output(["cmd", "/C"] + cmd, creationflags=0x08000000)
            except subprocess.CalledProcessError as cpe_error:
                out_put = "You have not switched branch\n"
                out_put += cpe_error.output
            out_put = str(out_put, "utf-8")
            
            return out_put
        
        def change_branch(branch_name):
            """
            switches to the selected branch
            """
            
            cb_msg = executor(["git", "checkout", branch_name])
            
            return cb_msg
        
        
        # CWD area ---------------------------------------------------------------------
        
        try:
            rsc.sticky["git_path"]
            os.chdir(rsc.sticky["git_path"])
        except:
            pass
        
        # Help production area ---------------------------------------------------------
        
        help = "Press the switch button to switch to the selected branch\n"
        if not branch: help +="\n* You need to enter a branch name first\n"
        help += "\n* You can use the 'select Branch' component to choose a branch\n"
        
        # Command execution area -------------------------------------------------------
        
        r = None
        if switch and branch:
            r = change_branch(branch)
        
        # Sticky area ------------------------------------------------------------------
        
        try:
            rsc.sticky["Githopper_11"]
        except:
            rsc.sticky["Githopper_11"] = None
        
        # Report area ------------------------------------------------------------------
        
        if rsc.sticky["Githopper_11"] == None:
            rsc.sticky["Githopper_11"] = r
            report = r
        else:
            report = rsc.sticky["Githopper_11"]
            rsc.sticky["Githopper_11"] = None
        
        return (report, help)
# ---------- end _11 ----------
_24 = GhPythonScript()  # -> report, help; inputs resolve: Boolean, abort: Boolean
# ---------- _24: Python ----------
"""Finishes the conflict resolve operation
    Inputs:
        resolve: Ends the merge operation (Button)
        abort: Aborts the merge operation (Button)
    Output:
        report: Output of the git operation
        help: Helpful tips about the git oporation"""

__author__ = "Amir Hossein Oliaee"
__version__ = "2019.06.24"

from subprocess import check_output
import subprocess
import os
import scriptcontext as rsc
from ghpythonlib.componentbase import executingcomponent as component
import Grasshopper, GhPython
import System
import Rhino
import rhinoscriptsyntax as rs

class MyComponent(component):
    
    def RunScript(self, resolve, abort):
        
        report = None
        help = None
        
        def executor(cmd):
            """
            This function executes the given command in the form of a list
            * It returns the output of the cmd prompt as a raw string
            """
            
            try:
                out_put = check_output(["cmd", "/C"] + cmd, creationflags=0x08000000)
            except subprocess.CalledProcessError as cpe_error:
                out_put = cpe_error.output
            out_put = str(out_put, "utf-8")
            
            return out_put
        
        def finish_merge(abort):
            """
            Finishes the merge process by continuing or aborting the oporation
            """
        
            if abort:
                try:
                    fm_msg = executor(["git","merge","--abort"])
                except subprocess.CalledProcessError as cpe_error:
                    fm_msg = cpe_error.output
                    fm_msg = str(fm_msg, "utf-8")
            else:
                try:
                    fm_msg = executor(["git","merge","--continue"])
                except subprocess.CalledProcessError as cpe_error:
                    fm_msg = cpe_error.output
                    fm_msg = str(fm_msg, "utf-8")
            
            return fm_msg
        
        
        # CWD area ---------------------------------------------------------------------
        
        try:
            rsc.sticky["git_path"]
            os.chdir(rsc.sticky["git_path"])
        except:
            pass
        
        # Command execution area -------------------------------------------------------
        
        r = None
        if resolve != abort:
            if resolve:
                r = finish_merge(False)
                if r != "" : r += "\n"
                r += "* Resolved conflicts will be implimented (check repository status for more info)"
            
            if abort:
                r = finish_merge(True)
                if r != "" : r += "\n"
                r = "The merge oporation will be aborted and file changes will be cancelled"
        
        
        # Help production area ---------------------------------------------------------
        
        help = "Press the abort or resolve button to finish resolving the merge conflict\n"
        
        if resolve == True and abort == True:
            help += "\n* You can not resolve and abort the oporation at the sae time !"
        
        # Sticky area ------------------------------------------------------------------
        
        try:
            rsc.sticky["Githopper_24"]
        except:
            rsc.sticky["Githopper_24"] = None
        
        # Report area ------------------------------------------------------------------
        
        if rsc.sticky["Githopper_24"] == None:
            rsc.sticky["Githopper_24"] = r
            report = r
        else:
            report = rsc.sticky["Githopper_24"]
            rsc.sticky["Githopper_24"] = None
        
        return (report, help)
# ---------- end _24 ----------
_9 = GhPythonScript()  # -> report, help; inputs create: Boolean
# ---------- _9: Python ----------
"""Initializes the git repository (git init equivalent)
    Inputs:
        name: The name of the created branch
        create: Triggers the git command (Button)
    Output:
        report: Output of the git operation
        help: Helpful tips about the git oporation"""

__author__ = "Amir Hossein Oliaee"
__version__ = "2019.06.24"

from subprocess import check_output
import subprocess
import os
import scriptcontext as rsc
from ghpythonlib.componentbase import executingcomponent as component
import Grasshopper, GhPython
import System
import Rhino
import rhinoscriptsyntax as rs

class MyComponent(component):
    
    def RunScript(self, name, create):
        
        report = None
        help = None
        
        def executor(cmd):
            """
            This function executes the given command in the form of a list
            * It returns the output of the cmd prompt as a raw string
            """
            
            try:
                out_put = check_output(["cmd", "/C"] + cmd, creationflags=0x08000000)
            except subprocess.CalledProcessError as cpe_error:
                out_put = cpe_error.output
            out_put = str(out_put, "utf-8")
            
            return out_put
        
        def create_branch(name):
            """
            creates a branch with the given name
            """
            
            cb_msg = executor(["git", "branch", name])
            
            return name
        
        
        # CWD area ---------------------------------------------------------------------
        
        try:
            rsc.sticky["git_path"]
            os.chdir(rsc.sticky["git_path"])
        except:
            pass
        
        # Command execution area -------------------------------------------------------
        
        r = None
        if create == True and name != None and not(name.count(" ") or name.count("\n")):
            r = create_branch(name) + " created"
        
        # Help production area ---------------------------------------------------------
        
        help = "Press the create button to create the new branch\n"
        if not name: help +="\n* You need to enter a branch name first\n"
        try:
            if name.count(" ") or name.count("\n"): help +="\n* Branch name can't conntain spaces or new lines\n"
        except:
            pass
        
        # Sticky area ------------------------------------------------------------------
        
        try:
            rsc.sticky["Githopper_9"]
        except:
            rsc.sticky["Githopper_9"] = None
        
        # Report area ------------------------------------------------------------------
        
        if rsc.sticky["Githopper_9"] == None:
            rsc.sticky["Githopper_9"] = r
            report = r
        else:
            report = rsc.sticky["Githopper_9"]
            rsc.sticky["Githopper_9"] = None
        
        return (report, help)
# ---------- end _9 ----------
_5 = GhPythonScript()  # -> status; inputs check: Boolean
# ---------- _5: Python ----------
"""Provides a status report of the local git repository
    Inputs:
        check: Refreshes the status (Button)
    Output:
        status: Status report of the local git repository"""

__author__ = "Amir Hossein Oliaee"
__version__ = "2019.06.24"

from subprocess import check_output
import subprocess
import os
import scriptcontext as rsc
from ghpythonlib.componentbase import executingcomponent as component
import Grasshopper, GhPython
import System
import Rhino
import rhinoscriptsyntax as rs

class MyComponent(component):
    
    def RunScript(self, check):
        
        status = None
        
        def executor(cmd):
            """
            This function executes the given command in the form of a list
            * It returns the output of the cmd prompt as a raw string
            """
            
            try:
                out_put = check_output(["cmd", "/C"] + cmd, creationflags=0x08000000)
            except subprocess.CalledProcessError as cpe_error:
                out_put = cpe_error.output
            out_put = str(out_put, "utf-8")
            
            return out_put
        
        def stat():
            """
            reports the status of the local repository
            """
            
            status_msg = executor(["git", "status"])
            
            return status_msg
        
        
        # CWD area ---------------------------------------------------------------------
        
        try:
            rsc.sticky["git_path"]
            os.chdir(rsc.sticky["git_path"])
        except:
            pass
        
        
        status = stat()
        
        
        return status
# ---------- end _5 ----------
_6 = GhPythonScript()  # -> graph
# ---------- _6: Python ----------
"""Provides a text graph of commits including branches and merges
    Inputs:
        check: Refreshes the graph (Button)
    Output:
        graph: Text graph of commits"""

__author__ = "Amir Hossein Oliaee"
__version__ = "2019.06.24"

from subprocess import check_output
import subprocess
import os
import scriptcontext as rsc
from ghpythonlib.componentbase import executingcomponent as component
import Grasshopper, GhPython
import System
import Rhino
import rhinoscriptsyntax as rs

class MyComponent(component):
    
    def RunScript(self, check):
        
        graph = None
        
        def executor(cmd):
            """
            This function executes the given command in the form of a list
            * It returns the output of the cmd prompt as a raw string
            """
            
            try:
                out_put = check_output(["cmd", "/C"] + cmd, creationflags=0x08000000)
            except subprocess.CalledProcessError as cpe_error:
                out_put = cpe_error.output
            out_put = str(out_put, "utf-8")
            
            return out_put
        
        def graph():
        
            """
            This function provides an ANSI text graph of the local repository
            """
        
            graph_msg = executor(["git", "log", "--graph", "--oneline", "--decorate", "--all"])
        
            return graph_msg
        
        
        # CWD area ---------------------------------------------------------------------
        
        try:
            rsc.sticky["git_path"]
            os.chdir(rsc.sticky["git_path"])
        except:
            pass
        
        
        graph = graph()
        
        return graph
# ---------- end _6 ----------
_17 = GhPythonScript()  # -> report, help; inputs reset: Boolean
# ---------- _17: Python ----------
"""Resets the files to the last commit state
    Inputs:
        reset: Triggers the git command (Button)
    Output:
        report: Output of the git operation
        help: Helpful tips about the git oporation"""

__author__ = "Amir Hossein Oliaee"
__version__ = "2019.06.24"

from subprocess import check_output, Popen
import subprocess
import os
import scriptcontext as rsc
from ghpythonlib.componentbase import executingcomponent as component
import Grasshopper, GhPython
import System
import Rhino
import rhinoscriptsyntax as rs

class MyComponent(component):
    
    def RunScript(self, reset):
        
        report = None
        help = None
        
        def executor(cmd):
            """
            This function executes the given command in the form of a list
            * It returns the output of the cmd prompt as a raw string
            """
            
            try:
                Popen(["cmd", "/C"] + cmd, creationflags=0x08000000)
            except:
                pass
        
        
        # CWD area ---------------------------------------------------------------------
        
        try:
            rsc.sticky["git_path"]
            os.chdir(rsc.sticky["git_path"])
        except:
            pass
        
        # Command execution area -------------------------------------------------------
        
        r = None
        if reset == True:
            executor(["git", "reset", "--hard"])
            r = "The repository has been reset to the last commit"
        
        # Help production area ---------------------------------------------------------
        
        help = "Press the reset button to reset the project to the state of the last commit"
        
        # Sticky area ------------------------------------------------------------------
        
        try:
            rsc.sticky["Githopper_17"]
        except:
            rsc.sticky["Githopper_17"] = None
        
        # Report area ------------------------------------------------------------------
        
        if rsc.sticky["Githopper_17"] == None:
            rsc.sticky["Githopper_17"] = r
            report = r
        else:
            report = rsc.sticky["Githopper_17"]
            rsc.sticky["Githopper_17"] = None
        
        return (report, help)
# ---------- end _17 ----------
_21 = GhPythonScript()  # -> help; inputs favor_this_side: Boolean, manual_resolve: Boolean, pull: Boolean
# ---------- _21: Python ----------
"""Pulls the remote repository changes to the local repository
    Inputs:
        branch: Name of the branch to be pulled
        favor_this_side: Determines whether to resolve conflicts by favoring this side of the pull (Toggle)
        manual_resolve: Determines whether to leave conflict solving to the user (Toggle)
        pull: Triggers the git command (Button)
    Output:
        help: Output of the git operation / Helpful tips"""

__author__ = "Amir Hossein Oliaee"
__version__ = "2019.06.24"

from ghpythonlib.componentbase import executingcomponent as component
import Grasshopper, GhPython
import System
import Rhino
import rhinoscriptsyntax as rs
from subprocess import check_output, Popen
import subprocess
import os
import scriptcontext as rsc

class MyComponent(component):
    
    def RunScript(self, branch, favor_this_side, manual_resolve, pull):
        
        help = None
        
        def executor(cmd):
            """
            This function executes the given command in the form of a list
            * It returns the output of the cmd prompt as a raw string
            """
            
            try:
                Popen(["cmd", "/C"] + cmd)
            except:
                pass
        
        def puller(options):
            """
            pushes repository to server
            """
            
            executor(["git", "pull"] + options)
        
        
        # CWD area ---------------------------------------------------------------------
        
        try:
            rsc.sticky["git_path"]
            os.chdir(rsc.sticky["git_path"])
        except:
            pass
        
        # Command execution area & help ------------------------------------------------
        
        if not manual_resolve:
            help = "Merge conflicts will be resolved automatically\n"
            if favor_this_side:
                conf_manager = "--strategy-option=ours"
                help += ("\n* In the case of a conflict it will be resolved"
                           " by favoring this side of the conflict")
            else:
                conf_manager = "--strategy-option=theirs"
                help += ("\n* In the case of a conflict it will be resolved"
                           " by favoring the other side of the conflict")
        else:
            conf_manager = "manual"
            help = ("Conflicting files will be altered\n"
                      "\n* You have to manualy edit the files and resolve the conflicts"
                      "\n\n* After manualy resolving the conflict make sure to use "
                      "\"Finish Conflict\" component to either resolve the merge conflict"
                      " or abort the oporation")
        
        pull_options = []
        
        if branch == None or branch == "": pull_options.append("--all")
        
        if conf_manager != "manual":
            pull_options.append(conf_manager)
        
        if branch != None: pull_options.append(branch)
        
        if pull:
            puller(pull_options)
        
        return help
# ---------- end _21 ----------
_15 = GhPythonScript()  # -> report, help; inputs files: list, modify: Boolean
# ---------- _15: Python ----------
"""Modifies the last commit
    Inputs:
        files: List of the selected files
        message: The new message to replace the last commit's message
        modify: Triggers the git command (Button)
    Output:
        report: Output of the git operation
        help: Helpful tips about the git oporation"""

__author__ = "Amir Hossein Oliaee"
__version__ = "2019.06.24"

from ghpythonlib.componentbase import executingcomponent as component
import Grasshopper, GhPython
import System
import Rhino
import rhinoscriptsyntax as rs
from subprocess import check_output
import subprocess
import os
import scriptcontext as rsc

class MyComponent(component):
    
    def RunScript(self, files, message, modify):
        
        report = None
        help = None
        
        def executor(cmd):
            """
            This function executes the given command in the form of a list
            * It returns the output of the cmd prompt as a raw string
            """
            
            try:
                out_put = check_output(["cmd", "/C"] + cmd, creationflags=0x08000000)
            except subprocess.CalledProcessError as cpe_error:
                out_put = cpe_error.output
            out_put = str(out_put, "utf-8")
            
            return out_put
        
        def amender(msg, f=[]):
            """
            This function saves the selected portion of the gh file from clipboard
            and commits it with the given massage
            * files: a list of file names that will be committed
            * if files contains "-A" then all files will be committed 
            """
            
            commit_msg = "" 
            
            for i in f:
                try:
                    executor(["git", "add", str(i)])
                except:
                    commit_msg += "Could not add" + str(i) + "to the repository\n"
            
            if msg == None or msg == "":
                commit_msg += executor(["git", "commit", "--amend", "--no-edit"])
            else:
                commit_msg += executor(["git", "commit", "--amend", "-m", msg])
            
            return commit_msg
        
        # CWD area ---------------------------------------------------------------------
        
        try:
            rsc.sticky["git_path"]
            os.chdir(rsc.sticky["git_path"])
        except:
            pass
        
        # Command execution area -------------------------------------------------------
        
        r = None
        if modify == True:
            r = amender(message, files)
        
        
        # Help production area ---------------------------------------------------------
        
        help = "Press the modify button to modify the last commit\n"
        if message == None: help += "\n* You can change the last commit's message by entering a message"
        
        # Sticky area ------------------------------------------------------------------
        
        try:
            rsc.sticky["Githopper_15"]
        except:
            rsc.sticky["Githopper_15"] = None
        
        # Report area ------------------------------------------------------------------
        
        if rsc.sticky["Githopper_15"] == None:
            rsc.sticky["Githopper_15"] = r
            report = r
        else:
            report = rsc.sticky["Githopper_15"]
            rsc.sticky["Githopper_15"] = None
        
        # return outputs if you have them; here I try it for you:
        return (report, help)
# ---------- end _15 ----------
_8 = GhPythonScript()  # -> branch, branches; inputs index: Int32
# ---------- _8: Python ----------
"""Selects the a git branch
    Inputs:
        index: index of the selected branch inside the branches list (int)
    Output:
        branch: The selected branch
        branches: List of all branches inside the local git repository"""

__author__ = "Amir Hossein Oliaee"
__version__ = "2019.06.24"

from subprocess import check_output
import subprocess
import os
import scriptcontext as rsc
from ghpythonlib.componentbase import executingcomponent as component
import Grasshopper, GhPython
import System
import Rhino
import rhinoscriptsyntax as rs

class MyComponent(component):
    
    def RunScript(self, index):
        
        branch = None
        branches = None
        
        def executor(cmd):
            """
            This function executes the given command in the form of a list
            * It returns the output of the cmd prompt as a raw string
            """
            
            try:
                out_put = check_output(["cmd", "/C"] + cmd, creationflags=0x08000000)
            except subprocess.CalledProcessError as cpe_error:
                out_put = cpe_error.output
            out_put = str(out_put, "utf-8")
            
            return out_put
        
        
        def branch_list():
            """
            Returns a list of existing branches
            """
            
            branch_list_msg = executor(["git", "branch"])
            
            return branch_list_msg
        
        
        # CWD area ---------------------------------------------------------------------
        
        try:
            rsc.sticky["git_path"]
            os.chdir(rsc.sticky["git_path"])
        except:
            pass
        
        # Command execution area -------------------------------------------------------
        
        branches = branch_list()
        
        raw = branches.strip("\n")
        raw = raw.split("\n")
        branch = None
        branches = []
        for i in range(len(raw)):
            raw[i] = raw[i].strip("*")
            raw[i] = raw[i].strip(" ")
        
            if i == index:
                branches.append( "> " + raw[i])
                branch = raw[i]
            else:
                branches.append( "  " + raw[i])
        
        return (branch, branches)
# ---------- end _8 ----------
_12 = GhPythonScript()  # -> commits; inputs check: Boolean
# ---------- _12: Python ----------
"""Lists all the commits in the local git repository
    Inputs:
        check: Refreshes the List (Button)
    Output:
        commits: List of all the commits in the git repository"""

__author__ = "Amir Hossein Oliaee"
__version__ = "2019.06.24"

from subprocess import check_output
import subprocess
import os
import scriptcontext as rsc
from ghpythonlib.componentbase import executingcomponent as component
import Grasshopper, GhPython
import System
import Rhino
import rhinoscriptsyntax as rs

class MyComponent(component):
    
    def RunScript(self, check):
        
        commits = None
        
        def executor(cmd):
            """
            This function executes the given command in the form of a list
            * It returns the output of the cmd prompt as a raw string
            """
            
            try:
                out_put = check_output(["cmd", "/C"] + cmd, creationflags=0x08000000)
            except subprocess.CalledProcessError as cpe_error:
                out_put = cpe_error.output
            out_put = str(out_put, "utf-8")
            
            return out_put
        
        def log():
            """
            This function provides a log of commits
            """
        
            log_msg = executor(["git", "log", "--oneline"])
        
            return log_msg
        
        
        # CWD area ---------------------------------------------------------------------
        
        try:
            rsc.sticky["git_path"]
            os.chdir(rsc.sticky["git_path"])
        except:
            pass
        
        commits = log()
        
        return commits
# ---------- end _12 ----------
_23 = GhPythonScript()  # -> help; inputs force: Boolean
# ---------- _23: Python ----------
"""Forcefully Pushes the local repository changes to the remote repository
    Inputs:
        branch: Name of the branch to be pushed
        repository: URL Address of the remote repository
        force: Triggers the git command (Button)
    Output:
        help: Output of the git operation / Helpful tips"""

__author__ = "Amir Hossein Oliaee"
__version__ = "2019.06.24"

from subprocess import check_output, Popen
import subprocess
import os
import scriptcontext as rsc
from ghpythonlib.componentbase import executingcomponent as component
import Grasshopper, GhPython
import System
import Rhino
import rhinoscriptsyntax as rs

class MyComponent(component):
    
    def RunScript(self, branch, repository, force):
        
        help = None
        
        def executor(cmd):
            """
            This function executes the given command in the form of a list
            * It returns the output of the cmd prompt as a raw string
            """
            
            try:
                Popen(["cmd", "/C"] + cmd, creationflags=0x08000000)
            except:
                pass
        
        def pusher(options):
            """
            pushes repository to server
            """
            
            executor(["git", "push"] + options)
        
        
        # CWD area ---------------------------------------------------------------------
        
        try:
            rsc.sticky["git_path"]
            os.chdir(rsc.sticky["git_path"])
        except:
            pass
        
        # Command execution area -------------------------------------------------------
        
        push_options = ["--force"]
        
        if branch == None: push_options.append("--all")
        
        if repository == None:
            push_options.append("origin")
        else:
            push_options.append(repository)
        
        if branch != None: push_options.append(branch)
        
        if force:
            pusher(push_options)
        
        # Help production area ---------------------------------------------------------
        
        help = ("Press the force_push button to replace the remote repository with "
                  "your local git repository"
                  "\n\n* Warning: this component is dangerous --> It will completely "
                  "wipe out the git history of your remote repository !!!"
                  "\n\n* This component will not effect your local repository")
        
        return help
# ---------- end _23 ----------
_25 = GhPythonScript()  # -> help; inputs execute: Boolean
# ---------- _25: Python ----------
"""Executes the given custom git command
    Inputs:
        command: The custom git command to run
        execute: Triggers the git command (Button)
    Output:
        help: Output of the git operation / Helpful tips"""

__author__ = "Amir Hossein Oliaee"
__version__ = "2019.06.24"

from subprocess import check_output, Popen
import subprocess
import os
import scriptcontext as rsc
from ghpythonlib.componentbase import executingcomponent as component
import Grasshopper, GhPython
import System
import Rhino
import rhinoscriptsyntax as rs

class MyComponent(component):
    
    def RunScript(self, command, execute):
        
        help = None
        
        def executor(cmd):
            """
            This function executes the given command in the form of a list
            * It returns the output of the cmd prompt as a raw string
            """
            
            try:
                Popen(["cmd", "/K"] + cmd)
            except:
                pass
        
        def parser(cmd):
            def index_finder(text,char):
                out_put = []
                b = 0
                
                for i in range(50):
                    try:
                        b = text.index(char, b+1)
                        out_put.append(b)
                    except:
                        break
                
                return out_put
            
            a = sorted(index_finder(cmd, "'") + index_finder(cmd, "\""))
            slices = [cmd[a[i]+1:a[i+1]] for i in range(0,len(a),2)]
            for i in slices: cmd = cmd.replace(i, "<>")
            cmd = cmd.split(" ")
            
            out_put = []
            for i in cmd:
                if  "<>" in i:
                    out_put.append(slices.pop(0))
                else:
                    out_put.append(i)
            
            return out_put
        
        
        # CWD area ---------------------------------------------------------------------
        
        try:
            rsc.sticky["git_path"]
            os.chdir(rsc.sticky["git_path"])
        except:
            pass
        
        # Command execution area & help ------------------------------------------------
        
        try:
            command_lst = command.split(" ")
            
            if command_lst[0] == "git" and execute:
                executor(parser(command))
            elif command_lst[0] != "git":
                help = "Invalid command (Please only use git commands)"
            else:
                help = ("Press execute button to run the command"
                          "\n\n* make sure to put file names in quotation or double quotation"
                          "\nExample:\ngit checkout HEAD~1 'some file.txt'")
        
        except:
            help = "You haven't entered a git command"
        
        return help
# ---------- end _25 ----------
_10 = GhPythonScript()  # -> report, help; inputs delete: Boolean
# ---------- _10: Python ----------
"""Deletes the selected branch
    Inputs:
        branch: The name of the branch to be deleted
        force: Determines whether the delete operation should be forced (Toggle)
        delete: Triggers the git command (Button)
    Output:
        report: Output of the git operation
        help: Helpful tips about the git oporation"""

__author__ = "Amir Hossein Oliaee"
__version__ = "2019.06.24"


from subprocess import check_output
import subprocess
import os
import scriptcontext as rsc
from ghpythonlib.componentbase import executingcomponent as component
import Grasshopper, GhPython
import System
import Rhino
import rhinoscriptsyntax as rs

class MyComponent(component):
    
    def RunScript(self, branch, delete):
        
        report = None
        help = None
        
        def executor(cmd):
            """
            This function executes the given command in the form of a list
            * It returns the output of the cmd prompt as a raw string
            """
            
            try:
                out_put = check_output(["cmd", "/C"] + cmd, creationflags=0x08000000)
            except subprocess.CalledProcessError as cpe_error:
                out_put = cpe_error.output
            out_put = str(out_put, "utf-8")
            
            return out_put
        
        def delete_branch(branch_name):
            """
            deletes the selected branch
            """
            
            db_msg = executor(["git", "branch", "-D", str(branch_name)])
            
            return db_msg
        
        
        # CWD area ---------------------------------------------------------------------
        
        try:
            rsc.sticky["git_path"]
            os.chdir(rsc.sticky["git_path"])
        except:
            pass
        
        # Command execution area -------------------------------------------------------
        
        r = None
        if branch != "master":
            if delete and branch != None:
                r = delete_branch(branch)
        else:
            r = "master branch can't be deleted"
        
        # Help production area ---------------------------------------------------------
        
        help = "Press the delete button to delete the selected branch\n"
        if not branch: help +="\n* You need to enter a branch name first\n"
        help += "\n* You can use the 'select Branch' component to choose a branch\n"
        
        # Sticky area ------------------------------------------------------------------
        
        try:
            rsc.sticky["Githopper_10"]
        except:
            rsc.sticky["Githopper_10"] = None
        
        # Report area ------------------------------------------------------------------
        
        if rsc.sticky["Githopper_10"] == None:
            rsc.sticky["Githopper_10"] = r
            report = r
        else:
            report = rsc.sticky["Githopper_10"]
            rsc.sticky["Githopper_10"] = None
        
        return (report, help)
# ---------- end _10 ----------
_18 = GhPythonScript()  # -> help; inputs reset: Boolean
# ---------- _18: Python ----------
"""Resets the repository to the selected commit (deletes the commits after that)
    Inputs:
        commit: The selected commit to reset to
        reset: Triggers the git command (Button)
    Output:
        help: Helpful tips about the git oporation"""

__author__ = "Amir Hossein Oliaee"
__version__ = "2019.06.24"

from subprocess import check_output, Popen
import subprocess
import os
import scriptcontext as rsc
from ghpythonlib.componentbase import executingcomponent as component
import Grasshopper, GhPython
import System
import Rhino
import rhinoscriptsyntax as rs

class MyComponent(component):
    
    def RunScript(self, commit, reset):
        
        help = None
        
        def executor(cmd):
            """
            This function executes the given command in the form of a list
            * It returns the output of the cmd prompt as a raw string
            """
            
            try:
                Popen(["cmd", "/C"] + cmd, creationflags=0x08000000)
            except:
                pass
        
        # CWD area ---------------------------------------------------------------------
        
        try:
            rsc.sticky["git_path"]
            os.chdir(rsc.sticky["git_path"])
        except:
            pass
        
        # Command execution area -------------------------------------------------------
        
        if reset and commit:
            executor(["git", "reset", "--hard",  commit])
        
        # Help production area ---------------------------------------------------------
        
        help = ("Press the reset button to reset the project to the last commit state"
                  "\n\n* Warning: this component is dangerous --> All the changes after "
                  "selected commit will be erased !!!")
        
        if not commit: help += "\n\n* Please first enter the selected commit"
        
        return help
# ---------- end _18 ----------
_13 = GhPythonScript()  # -> files, directory; inputs indexes: list, select_all: Boolean
# ---------- _13: Python ----------
"""Selects files in the working directory
    Inputs:
        indexes: Indexs of the selected files inside the directory (int list)
        select_all: Determines whether all files should be selected (Toggle)
    Output:
        files: Selected files
        directory: List of all the files inside the current directory"""

__author__ = "Amir Hossein Oliaee"
__version__ = "2019.06.24"

from os import listdir, getcwd
from os.path import isfile, join
import scriptcontext as rsc
from ghpythonlib.componentbase import executingcomponent as component
import Grasshopper, GhPython
import System
import Rhino
import rhinoscriptsyntax as rs

class MyComponent(component):
    
    def RunScript(self, indexes, select_all):
        
        files = None
        directory = None
        
        # CWD area ---------------------------------------------------------------------
        
        try:
            rsc.sticky["git_path"]
            os.chdir(rsc.sticky["git_path"])
        except:
            pass
        
        # Command execution area -------------------------------------------------------
        
        mypath = getcwd()
        f_list = listdir(mypath)
        
        try:
            f_list.remove(".git")
        except:
            pass
        
        if len(indexes) == 1:
            indexes = indexes[0].split("\n")
            indexes = [i.strip("\r") for i in indexes]
        
        temp_list = []
        for i in indexes:
            try:
                temp_list.append(int(i))
            except:
                pass
        indexes = temp_list
        
        files = []
        directory = []
        
        for f in range(len(f_list)):
            if isfile(join(mypath, f_list[f])):
                if f in indexes:
                    files.append(f_list[f])
                    directory.append ("> " + str(f_list[f]))
                else:
                    directory.append ("  " + str(f_list[f]))
            else:
                if f in indexes:
                    files.append(f_list[f])
                    directory.append ("> " + str(f_list[f]) + " (dir)")
                else:
                    directory.append ("  " + str(f_list[f]) + " (dir)")
        
        if select_all:
            files = ["-A"]
            directory = ["> " + str(f) for f in f_list]
        
        return (files, directory)
# ---------- end _13 ----------
_16 = GhPythonScript()  # -> commit, commits; inputs index: Int32
# ---------- _16: Python ----------
"""Selects a git commit
    Inputs:
        index: index of the selected commit inside the commits list (int)
    Output:
        commit: The selected commit
        commits: List of all commits inside the local git repository"""

__author__ = "Amir Hossein Oliaee"
__version__ = "2019.06.24"

from subprocess import check_output
import subprocess
import os
import scriptcontext as rsc
from ghpythonlib.componentbase import executingcomponent as component
import Grasshopper, GhPython
import System
import Rhino
import rhinoscriptsyntax as rs

class MyComponent(component):
    
    def RunScript(self, index):
        
        commit = None
        commits = None
        
        def executor(cmd):
            """
            This function executes the given command in the form of a list
            * It returns the output of the cmd prompt as a raw string
            """
            
            try:
                out_put = check_output(["cmd", "/C"] + cmd, creationflags=0x08000000)
            except subprocess.CalledProcessError as cpe_error:
                out_put = cpe_error.output
            out_put = str(out_put, "utf-8")
            
            return out_put
        
        def log():
            """
            This function provides a log of commits
            """
        
            log_msg = executor(["git", "log", "--oneline"])
        
            return log_msg
        
        
        # CWD area ---------------------------------------------------------------------
        
        try:
            rsc.sticky["git_path"]
            os.chdir(rsc.sticky["git_path"])
        except:
            pass
        
        
        try:
            commits = log()
            
            if not len(commits):
                commits = "nothing has been commited yet"
            
            raw = commits.strip("\n")
            raw = raw.split("\n")
            
            commits = []
            for i in range(len(raw)):
                raw[i] = raw[i].split(" ")
                if i == index:
                    commits.append("> " + " ".join(raw[i][1:]))
                    commit = raw[i][0]
                else:
                    commits.append("  " + " ".join(raw[i][1:]))
        except:
            commit = "No commit has been selected"
        
        return (commit, commits)
# ---------- end _16 ----------
_19 = GhPythonScript()  # -> report, help; inputs files: list, revert: Boolean
# ---------- _19: Python ----------
"""Reverts the selected files to the selected commit's state
    Inputs:
        commit: Selected commit to revert the files state to
        files: Selected files to revert
        revert: Triggers the git command (Button)
    Output:
        report: Output of the git operation
        help: Helpful tips about the git oporation"""

__author__ = "Amir Hossein Oliaee"
__version__ = "2019.06.24"

from ghpythonlib.componentbase import executingcomponent as component
import Grasshopper, GhPython
import System
import Rhino
import rhinoscriptsyntax as rs
from subprocess import check_output
import subprocess
import os
import scriptcontext as rsc

class MyComponent(component):
    
    def RunScript(self, commit, files, revert):
        
        report = None
        help = None
        
        def executor(cmd):
            """
            This function executes the given command in the form of a list
            * It returns the output of the cmd prompt as a raw string
            """
            
            try:
                out_put = check_output(["cmd", "/C"] + cmd, creationflags=0x08000000)
            except subprocess.CalledProcessError as cpe_error:
                out_put = cpe_error.output
            out_put = str(out_put, "utf-8")
            
            return out_put
        
        
        # CWD area ---------------------------------------------------------------------
        
        try:
            rsc.sticky["git_path"]
            os.chdir(rsc.sticky["git_path"])
        except:
            pass
        
        # Command execution area -------------------------------------------------------
        
        r = None
        if revert and commit and files:
            if files[0] == "-A":
                r = "You can not revert all files (you can use \"hard reset\" component for that)"
            else:
                r = ""
                for i in files:
                    try:
                        temp = executor(["git", "checkout", commit, str(i)]) + "\n"
                        if temp != None or temp != "":
                            r += temp
                    except:
                        r += "Could not revert " + str(i) + "\n"
                if r == None or r == "":
                    r = "revert oporation finished"
        
        # Help production area ---------------------------------------------------------
        
        help = "Press the revert button to revert the selected files to the selected commit state"
        if not commit: help += "\n\n* Please first enter the commit"
        if not files: help += "\n\n* Please remember to add the file names"
        
        # Sticky area ------------------------------------------------------------------
        
        try:
            rsc.sticky["Githopper_19"]
        except:
            rsc.sticky["Githopper_19"] = None
        
        # Report area ------------------------------------------------------------------
        
        if rsc.sticky["Githopper_19"] == None:
            rsc.sticky["Githopper_19"] = r
            report = r
        else:
            report = rsc.sticky["Githopper_19"]
            rsc.sticky["Githopper_19"] = None
        
        return (report, help)
# ---------- end _19 ----------

# ---- group: diff (boken)
# Extreme components
python_26 = GhPythonScript()  # -> Out, A

# ---- group: create licence file
python_27 = GhPythonScript()  # -> Out, A

# ----
python_28 = GhPythonScript()  # -> out, a
# ---------- python_28: Python ----------
from subprocess import check_output, Popen
import subprocess
import os
import scriptcontext as rsc

def executor(cmd):
    """
    This function executes the given command in the form of a list
    * It returns the output of the cmd prompt as a raw string
    """
    
    try:
        Popen(["cmd", "/C"] + cmd)
    except:
        pass

def clone_repository(repository_address, user_name, user_email):
    """
    Clones the remote repository from it's address
    """
    
    executor(["git", "clone", str(repository_address)]+a+b)
    
    a = ["&", "cmd", "/C", "git", "config", "user.name", user_name]
    b = ["&", "cmd", "/C", "git", "config", "user.email", user_email]
# ---------- end python_28 ----------

# ---- group: Cteate gitignore / gitignore
python_29 = GhPythonScript(replace=Toggle(False))  # -> result, help; inputs replace: Boolean, create: Boolean
# ---------- python_29: Python ----------
"""Creates the .gitignore file
    Inputs:
        gitignore_text: The content to add to the gitignore file
        replace: Determines whether to replace the content of gitignore file (Toggle)
        create: Triggers the git command (Button)
    Output:
        result: The resulting content of the gitignore file
        help: Output of the git operation / Helpful tips"""

__author__ = "Amir Hossein Oliaee"
__version__ = "2019.06.24"

import os
import scriptcontext as rsc

def reporter():
    
    if exist:
        if replace:
            out_put = "Press create button to overwrite the .gitignore file\n"
            if i_f:
                out_put +="\n* gitignore file will be empty (no file has been specified)"
        else:
            out_put = "Press create button to append to the .gitignore file\n"
            if i_f:
                out_put +="\n* gitignore file won't be modified (no file has been specified)"
    else:
        out_put = "Press create button to create the .gitignore file\n"
        if i_f:
            out_put += "\n* gitignore file will be empty (no file has been specified)"
    return out_put


# CWD area ---------------------------------------------------------------------

try:
    rsc.sticky["git_path"]
    os.chdir(rsc.sticky["git_path"])
except:
    pass

# Command execution area -------------------------------------------------------

try:
    with open(".gitignore","r") as f:
        result = f.read()
    exist = True
except:
    exist = False

i_f = gitignore_text == None

r = None
if create == True:
    temp = gitignore_text.split("\n")
    temp = [i.strip("\r") for i in temp]
    
    if replace:
        with open(".gitignore", "w+") as i:
            for j in temp:
                i.write(j + "\n")
        r = "file creation successful"
    else:
        with open(".gitignore", "a+") as i:
            for j in temp:
                i.write(j + "\n")
        r = "file modification successful"
else:
    r = reporter()

# Sticky area ------------------------------------------------------------------

try:
    rsc.sticky["Githopper_26"]
except:
    rsc.sticky["Githopper_26"] = None

# Report area ------------------------------------------------------------------

if rsc.sticky["Githopper_26"] == None:
    rsc.sticky["Githopper_26"] = r
    help = r
else:
    help = rsc.sticky["Githopper_26"]
    rsc.sticky["Githopper_26"] = None
# ---------- end python_29 ----------

# ---- group: Create README / README
python_30 = GhPythonScript(replace=Toggle(False))  # -> result, help; inputs replace: Boolean, create: Boolean
# ---------- python_30: Python ----------
"""Creates the README.md file
    Inputs:
        README_text: The content to add to the README file
        replace: Determines whether to replace the content of README file (Toggle)
        create: Triggers the git command (Button)
    Output:
        result: The resulting content of the README file
        help: Output of the git operation / Helpful tips"""

__author__ = "Amir Hossein Oliaee"
__version__ = "2019.06.24"

import os
import scriptcontext as rsc

def reporter():
    
    if exist:
        if replace:
            out_put = "Press create button to overwrite the README file\n"
            if i_f:
                out_put +="\n* README file will be empty (no file has been specified)"
        else:
            out_put = "Press create button to append to the README file\n"
            if i_f:
                out_put +="\n* README file won't be modified (no text has been specified)"
    else:
        out_put = "Press create button to create the README file\n"
        if i_f:
            out_put += "\n* README file will be empty (no file has been specified)"
    return out_put


# CWD area ---------------------------------------------------------------------

try:
    rsc.sticky["git_path"]
    os.chdir(rsc.sticky["git_path"])
except:
    pass

# Command execution area -------------------------------------------------------

try:
    with open("README.md","r") as f:
        result = f.read()
    exist = True
except:
    exist = False

i_f = README_text == None

r = None
if create == True:
    temp = README_text.split("\n")
    temp = [i.strip("\r") for i in temp]
    
    if replace:
        with open("README.md", "w+") as i:
            for j in temp:
                i.write(j + "\n")
        r = "file creation successful"
    else:
        with open("README.md", "a+") as i:
            for j in temp:
                i.write(j + "\n")
        r = "file modification successful"
else:
    r = reporter()

# Sticky area ------------------------------------------------------------------

try:
    rsc.sticky["Githopper_27"]
except:
    rsc.sticky["Githopper_27"] = None

# Report area ------------------------------------------------------------------

if rsc.sticky["Githopper_27"] == None:
    rsc.sticky["Githopper_27"] = r
    help = r
else:
    help = rsc.sticky["Githopper_27"]
    rsc.sticky["Githopper_27"] = None
# ---------- end python_30 ----------
